# Grasshopper definition NP_slicing.gh (Grasshopper 1.0.8)

py3 = Python3Script()  # -> Curves, Levels, Components, Errors
# ---------- py3: Python ----------
"""Grasshopper helper for turning NP_slicing JSON exports into Rhino curves.

Usage in GhPython component (Rhino 7/8):
    * Create inputs named `path` (text) and optionally `close_tol` (number).
    * Set both inputs to type hint `text` / `float` and access mode `item`.
    * Add four outputs: `Curves`, `Levels`, `Components`, `Errors`.
    * Paste this script into the component body.

`path` should point to the JSON file exported by `export_slice_collection_to_json`.
`close_tol` defines the tolerance used to decide whether a component is closed.
"""

import json
import os

import Rhino.Geometry as rg


def _coerce_path(input_path):
    if not input_path:
        raise ValueError("No JSON path supplied.")
    expanded = os.path.expandvars(str(input_path).strip("\""))
    absolute = os.path.abspath(expanded)
    if not os.path.isfile(absolute):
        raise IOError("JSON file not found: {}".format(absolute))
    return absolute


def _ensure_closed(points, tolerance):
    if len(points) < 2:
        return points
    if points[0].DistanceTo(points[-1]) <= tolerance:
        points[-1] = points[0]
    return points


def _component_points(component):
    pts = component.get("points") or []
    clean = []
    for pt in pts:
        if not pt or len(pt) < 3:
            continue
        clean.append(rg.Point3d(float(pt[0]), float(pt[1]), float(pt[2])))
    return clean


def _slice_components(slice_entry):
    components = slice_entry.get("components") or []
    if not components:
        curve_points = slice_entry.get("curve")
        if curve_points:
            components = [{"points": curve_points}]
        else:
            raw_points = slice_entry.get("raw_points") or []
            if raw_points:
                components = [{"points": raw_points}]
    return components


def load_slice_curves(json_path, close_tol=1.0e-6):
    """Return Rhino polyline curves plus metadata from a slicer JSON export."""
    path = _coerce_path(json_path)
    close_tol = float(close_tol or 0.0)

    with open(path, "r") as handle:
        payload = json.load(handle)

    slices = payload.get("slices") or []
    curves = []
    levels = []
    components = []

    for slice_entry in slices:
        level = float(slice_entry.get("level", 0.0))
        comp_list = _slice_components(slice_entry)
        for index, comp in enumerate(comp_list):
            pts = _component_points(comp)
            if len(pts) < 2:
                continue
            pts = _ensure_closed(pts, close_tol)
            polyline = rg.PolylineCurve(pts)
            if not polyline.IsValid or polyline.PointCount < 2:
                continue
            curves.append(polyline)
            levels.append(level)
            components.append(index)

    return curves, levels, components


# ----------------------------------------------------------------------
# Grasshopper glue
# ----------------------------------------------------------------------

Curves = []
Levels = []
Components = []
Errors = None

try:
    close_tol_value =  1.0e-6
    result = load_slice_curves(path, close_tol_value)
    Curves, Levels, Components = result
    if not Curves:
        Errors = "No valid curves were generated from the JSON file."
except Exception as exc:
    Errors = str(exc)
# ---------- end py3 ----------
