# Grasshopper definition curved_slicing_master.gh (Grasshopper 1.0.7)
# plug-ins: Weaverbird, MeshEdit Components, Super Delaunay 2d

data_folder_name = Panel("whole\")
data_folder_name_2 = Panel("Jun_ab_testmultipipe\")
data_folder_name_3 = Panel("table_1\")
data_folder_name_4 = Panel("Jul_ab\")
data_folder_name_5 = Panel("Jul_h\")
data_folder_name_6 = Panel("Jun_ae_testa\")
data_folder_name_7 = Panel("Jun_ah_testa\")
data_folder_name_8 = Panel("example_jun_bg\")

# ---- group: folders
data_folder_name_9 = Panel("data_vase\")
data_folder_name_10 = Panel("data_Y_shape\")
data_folder_name_11 = Panel("data_costa_surface\")

data_folder_name_12 = Panel("data_vase_o\")
data_folder_name_13 = Panel("data_Y_shape_o\")
data_folder_name_14 = Panel("data_costa_surface_o\")

# ----
data_folder_name_15 = Panel("Jun_ah_testb\")
data_folder_name_16 = Panel("Jul_I\")
data_folder_name_17 = Panel("table_2\")
data_folder_name_18 = Panel("Jul_ah\")
data_folder_name_19 = Panel("Jul_ba\")
data_folder_name_20 = Panel("Aug_bg\")
data_folder_name_21 = Panel("Aug_bh\")
data_folder_name_22 = Panel("Jul_ai\")
data_folder_name_23 = Panel("E1")
data_folder_name_24 = Panel("E2")
data_folder_name_25 = Panel("Aug_ac_ex\")
data_folder_name_26 = Panel("O2")
data_folder_name_27 = Panel("O1")
data_folder_name_28 = Panel("E3")
data_folder_name_29 = Panel("E4")
data_folder_name_30 = Panel("csch2")
data_folder_name_31 = Panel("O4")
data_folder_name_32 = Panel("csch")
data_folder_name_33 = Panel("O3")
data_folder_name_34 = Panel("whole_")
data_folder_name_35 = Panel("beam1A")
data_folder_name_36 = Panel("beam1B")
data_folder_name_37 = Panel("beam2A")
data_folder_name_38 = Panel("beam2B")
data_folder_name_39 = Panel("beam2C")
data_folder_name_40 = Panel("beam3A")
data_folder_name_41 = Panel("beam3B")
data_folder_name_42 = Panel("beam1C")
data_folder_name_43 = Panel("beam3C")
data_folder_name_44 = Panel("MNNaCl1")
data_folder_name_45 = Panel("min1")
data_folder_name_46 = Panel("beam_new")
data_folder_name_47 = Panel("beam_testprint")

# ---- group: Select example
list = ValueList({"Vase": 0, "Y shape": 1, "Costa surface": 2, "Whole": 3, "Vo": 4, "Yo": 5, "Co": 6, "Jun_ab_testmultipipe": 7, "Jun_ae_testa": 8, "Jun_ah_testa": 9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}, selected="beam-testprint": 46)

# ----
merge = Merge(
    Data1=flatten(data_folder_name_9),
    Data2=flatten(data_folder_name_10),
    Data3=flatten(data_folder_name_11),
    Data4=flatten(data_folder_name),
    Data5=flatten(data_folder_name_12),
    Data6=flatten(data_folder_name_13),
    Data7=flatten(data_folder_name_14),
    Data8=flatten(data_folder_name_2),
    Data9=flatten(data_folder_name_6),
    Data10=flatten(data_folder_name_7),
    Data11=flatten(data_folder_name_15),
    Data12=flatten(data_folder_name_8),
    Data13=flatten(data_folder_name_5),
    Data14=flatten(data_folder_name_16),
    Data15=flatten(data_folder_name_4),
    Data16=flatten(data_folder_name_18),
    Data17=flatten(data_folder_name_22),
    Data18=flatten(data_folder_name_19),
    Data19=flatten(data_folder_name_3),
    Data20=flatten(data_folder_name_17),
    Data21=flatten(data_folder_name_25),
    Data22=flatten(data_folder_name_20),
    Data23=flatten(data_folder_name_21),
    Data24=data_folder_name_27,
    Data25=data_folder_name_23,
    Data26=data_folder_name_26,
    Data27=data_folder_name_24,
    Data28=data_folder_name_33,
    Data29=data_folder_name_28,
    Data30=data_folder_name_31,
    Data31=data_folder_name_29,
    Data32=data_folder_name_32,
    Data33=data_folder_name_30,
    Data34=data_folder_name_34,
    Data35=data_folder_name_35,
    Data36=data_folder_name_36,
    Data37=data_folder_name_37,
    Data38=data_folder_name_38,
    Data39=data_folder_name_40,
    Data40=data_folder_name_41,
    Data41=data_folder_name_42,
    Data42=data_folder_name_39,
    Data43=data_folder_name_43,
    Data44=data_folder_name_44,
    Data45=data_folder_name_45,
    Data46=data_folder_name_46,
    Data47=data_folder_name_47)
button = Button()
item = ListItem(List=merge, Index=list, Wrap=True)
data = Data("C:\Users\Ke Dao\Documents\BaiduSyncdisk\Desktop\3D_Printing_Beam\slicer_code_test")

# ----
# Inputs
py = PythonScript()  # -> path
# ---------- py: Python ----------
import sys
import os

ghComp = ghenv.Component
ghDoc = ghComp.OnPingDocument()

# the full path of the gh file
path = ghDoc.FilePath
# the current directory 
path = os.path.abspath(os.path.join(path, ".."))

print path
# ---------- end py ----------

# ---- group: Folder name
data_2 = Data(item)

# ----
load_mesh = GhPythonScript(recompute=Button(), path=py, folder=data_2, filename="edited_mesh.obj")  # -> out, mesh
# ---------- load_mesh: Python ----------
__author__ = "ioanna"

import os
import Rhino.Geometry as rg
import rhinoscriptsyntax as rs
from compas.datastructures import Mesh
from compas_ghpython.artists import MeshArtist
from compas.geometry import Frame
from compas_ghpython.utilities import list_to_ghtree


vertices = []
faces = []

with open(os.path.join(path, folder, 'output', filename), "r") as file:
    for line in file:
        if line.startswith('#'):
            continue
        values = line.split()
        if not values:
            continue
            
        if values[0] == 'v':
            v = list(map(float, values[1:4]))
            vertices.append(v)
        elif values[0] == 'f':
            face = [int(w.split('/')[0]) for w in values[1:]]
            faces.append(face)
        
print('Vertices : ', len(vertices))    
print('Faces : ', len(faces))


mesh = rg.Mesh()

for v in vertices:
    mesh.Vertices.Add(v[0], v[1], v[2]);
for i, f in enumerate(faces):
    mesh.Faces.AddFace(f[0]-1, f[1]-1, f[2]-1);
    



#mesh = Mesh.from_vertices_and_faces(vertices, faces)
#mesh = Mesh.from_obj(os.path.join(path, folder, 'output', filename))


#print (len(list(mesh.vertices())))
#artist = MeshArtist(mesh)
#mesh = artist.draw()
# ---------- end load_mesh ----------
load_mesh_2 = GhPythonScript(recompute=Button(), path=py, folder=data_2, filename="edited_mesh.obj")  # -> out, mesh
# ---------- load_mesh_2: Python ----------
__author__ = "ioanna"

import os
import Rhino.Geometry as rg
import rhinoscriptsyntax as rs
from compas.datastructures import Mesh
from compas_ghpython.artists import MeshArtist
from compas.geometry import Frame
from compas_ghpython.utilities import list_to_ghtree


vertices = []
faces = []

for line in open(os.path.join(path, folder, 'output',filename), "r"):
    if line.startswith('#'): 
        continue
    values = line.split()
    if not values: 
        continue
        
    if values[0] == 'v':
        v = map(float, values[1:4])
        vertices.append(v)
    elif values[0] == 'f':
        face = []
        for v in values[1:]:
            w = v.split('/')
            face.append(int(w[0]))
        faces.append(face)
        
print('Vertices : ', len(vertices))    
print('Faces : ', len(faces))


mesh = rg.Mesh()

for v in vertices:
    mesh.Vertices.Add(v[0], v[1], v[2]);
for i, f in enumerate(faces):
    mesh.Faces.AddFace(f[0]-1, f[1]-1, f[2]-1);
    



#mesh = Mesh.from_vertices_and_faces(vertices, faces)
#mesh = Mesh.from_obj(os.path.join(path, folder, 'output', filename))


#print (len(list(mesh.vertices())))
#artist = MeshArtist(mesh)
#mesh = artist.draw()
# ---------- end load_mesh_2 ----------
load_mesh_3 = GhPythonScript(recompute=Button(), path=py, folder=data_2, filename="cutted_mesh.obj")  # -> out, mesh; same code as load_mesh_2
load_mesh_4 = GhPythonScript(recompute=Button(), path=py, folder=data_2, filename="mesh.obj")  # -> out, mesh
# ---------- load_mesh_4: Python ----------
__author__ = "ioanna"

import os
import Rhino.Geometry as rg
import rhinoscriptsyntax as rs
from compas.datastructures import Mesh
from compas_ghpython.artists import MeshArtist
from compas.geometry import Frame
from compas_ghpython.utilities import list_to_ghtree


vertices = []
faces = []

with open(os.path.join(path, folder,  filename), "r") as file:
    for line in file:
        if line.startswith('#'):
            continue
        values = line.split()
        if not values:
            continue
            
        if values[0] == 'v':
            v = list(map(float, values[1:4]))
            vertices.append(v)
        elif values[0] == 'f':
            face = [int(w.split('/')[0]) for w in values[1:]]
            faces.append(face)
        
print('Vertices : ', len(vertices))    
print('Faces : ', len(faces))


mesh = rg.Mesh()

for v in vertices:
    mesh.Vertices.Add(v[0], v[1], v[2]);
for i, f in enumerate(faces):
    mesh.Faces.AddFace(f[0]-1, f[1]-1, f[2]-1);
    



#mesh = Mesh.from_vertices_and_faces(vertices, faces)
#mesh = Mesh.from_obj(os.path.join(path, folder, 'output', filename))


#print (len(list(mesh.vertices())))
#artist = MeshArtist(mesh)
#mesh = artist.draw()
# ---------- end load_mesh_4 ----------
mesh = Mesh(load_mesh.mesh)
mesh_2 = Mesh(load_mesh_2.mesh)
mesh_3 = Mesh(load_mesh_4.mesh)
demesh = DeconstructMesh(Mesh=load_mesh_3.mesh)  # -> Vertices, Faces, Colours, Normals
panel = Panel(mesh)
panel_2 = Panel(py)
panel_3 = Panel(data_2)
list_length = ListLength(List=demesh.Faces)
mesh_4 = Mesh(mesh)
panel_4 = Panel(list_length)

# ---- group: Input mesh
mesh_5 = Mesh(mesh_4)

# ----
face_boundaries = FaceBoundaries(Mesh=mesh_5)
explode = Explode(Curve=face_boundaries, Recursive=True)  # -> Segments, Vertices

# ----
# Animation controling
number_slider = Slider(115, range=0..115)

subtraction = Subtraction(A="101", B="1")
volume = Volume(Geometry=mesh_4)  # -> Volume, Centroid
division = Division(A=number_slider, B="50")
subtraction_2 = Subtraction(A="101", B=number_slider)
ghpython_script = GhPythonScript(x=number_slider)  # -> out, a; inputs x: Int32
# ---------- ghpython_script: Python ----------
if x<=100:
    a=x
else:
    a=200-x
# ---------- end ghpython_script ----------
addition = Addition(A=subtraction_2, B="1")
division_2 = Division(A=number_slider, B=subtraction)
# Results
construct_path = ConstructPath(Indices=number_slider)
ghpython_script_2 = GhPythonScript(x=division_2)  # -> out, a
# ---------- ghpython_script_2: Python ----------
if x>0.66666:
    a=1
else:
    a=0.1*x+(1-0.66666)
# ---------- end ghpython_script_2 ----------
panel_5 = Panel(division_2)
# Input
length = Length(Curve=explode.Segments)
panel_6 = Panel(mesh_5)

# ----
# Load Printpoints
panel_7 = Panel("out_printpoints")
button_2 = Button()
csfindfilenames = CsFindFilenames(recompute=button_2, starts_with=panel_7, ends_with="json", path=py, folder_name=data_2)  # -> out, filenames, n; inputs recompute: Boolean
# ---------- csfindfilenames: Python ----------
"""
Finds all the filenames from the output directory that have the specified name. 

"""

import compas_slicer_ghpython.visualization as gh_compas_slicer
gh_compas_slicer = reload(gh_compas_slicer)
import os

if starts_with and ends_with and path and folder_name:
    filenames = gh_compas_slicer.get_files_with_name(starts_with, ends_with, os.path.join(path, folder_name, 'output'))
    n = len(filenames)
else:
    gh_compas_slicer.missing_input()
# ---------- end csfindfilenames ----------
csloadprintpoints = CsLoadPrintpoints(recompute=button_2, json_name=csfindfilenames.filenames, path=py, folder_name=data_2)  # -> out, geometry, points, frames, layer_heights, up_vectors, mesh_normals, closest_support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; inputs recompute: Boolean
# ---------- csloadprintpoints: Python ----------
"""
Loads a dictionaly of Printpoints from a json file in the 'output' folder.

"""

import compas_slicer_ghpython.visualization as gh_compas_slicer
gh_compas_slicer = reload(gh_compas_slicer)


if path and folder_name and json_name:
    points, frames, layer_heights, up_vectors, mesh_normals, closest_support, velocities, wait_times, \
    blend_radiuses, extruder_toggles = \
        gh_compas_slicer.load_printpoints(path, folder_name, json_name)
    
else:
    gh_compas_slicer.missing_input()
# ---------- end csloadprintpoints ----------

# ----
# Create boundary vertices file (json)
mesh_6 = Mesh(mesh_3)
medges = MeshEdges(Mesh=mesh_6)  # -> NakedEdges, InteriorEdges, NonManifoldEdges
delaunay = Delaunay()  # -> Delaunay, Edges, EdgesTopology

# ---- group: Path cross-section
# Visualization
number_slider_2 = Slider(2.5, range=0..10)
xz = XZPlane(Origin=Point(0, 0, 0))
rectangle = Rectangle(Plane=xz, XSize=number_slider_2, YSize=Slider(1, range=0..10), Radius=Slider(0.43, range=0..1))  # -> Rectangle, Length

# ----
ghpython_script_3 = GhPythonScript(x=Button(), path=py, folder_name=data_2)  # -> out, filenames
# ---------- ghpython_script_3: Python ----------
import visualization as vis
vis=reload(vis)
filenames=vis.load_slicer_names(path,folder_name)
# ---------- end ghpython_script_3 ----------

# ----
# Load Slicer
button_3 = Button()
csloadslicer = CsLoadSlicer(recompute=button_3, json_name=ghpython_script_3.filenames, path=py, folder_name=data_2)  # -> out, mesh, paths, are_closed, all_points, gras, pts; inputs recompute: Boolean
# ---------- csloadslicer: Python ----------
"""
Loads a Slicer class from its json file in the 'output' folder.

"""

import compas_slicer_ghpython.visualization as gh_compas_slicer
gh_compas_slicer = reload(gh_compas_slicer)
import math
import visualization as vis
vis=reload(vis)

if path and folder_name and json_name:
    try:
        paths,pts, gras= vis.load_slicer_tree(path, folder_name, json_name,0.00213,0.00052,math.pi/10,False)
    except:
        mesh,paths,are_closed,all_points=gh_compas_slicer.load_slicer(path,folder_name,json_name)
else:
    gh_compas_slicer.missing_input()
import rhinoscriptsyntax as rs
# ---------- end csloadslicer ----------

join = JoinCurves(Curves=flatten(medges.NakedEdges), Preserve=False)
ghpython_script_4 = GhPythonScript(path=py, foldername=data_2, jsonname="streamlinepolylines.json")  # -> out, paths
# ---------- ghpython_script_4: Python ----------
import visualization as vis
vis = reload(vis)
print(path)
print(foldername)
print(jsonname)
paths=vis.load_polyline_list(path,foldername,jsonname)
# ---------- end ghpython_script_4 ----------

# ----
# Single distance list
# Debugging
button_4 = Button()
offset = Slider(29.1, range=0..200)
csloadjsondata = CsLoadJsonData(recompute=button_4, json_name="distances_LOW.json", path=py, folder_name=data_2)  # -> out, data; inputs recompute: Boolean
# ---------- csloadjsondata: Python ----------
"""Loads a json file from the output folder. """

import compas_slicer_ghpython.visualization as gh_compas_slicer
gh_compas_slicer = reload(gh_compas_slicer)

if json_name and path and folder_name:
    data = gh_compas_slicer.load_json_file(path, folder_name, json_name)
else:
    gh_compas_slicer.missing_input()
# ---------- end csloadjsondata ----------
bnd = Bounds(Numbers=csloadjsondata.data)
bounds = Panel(bnd)
olffset = GhPythonScript(values=csloadjsondata.data, offset=offset)  # -> a; inputs values: list
# ---------- olffset: Python ----------
a = [v-offset for v in values]
# ---------- end olffset ----------

item_2 = ListItem(List=flatten(join), Index=0, Wrap=True)  # -> Item, Item1, Item2, Item3, Item4, Item5
panel_8 = Panel(csfindfilenames.filenames)
item_3 = ListItem(List=flatten(join), Index=0, Wrap=False)  # -> Item, Item1, Item2, Item3, Item4, Item5, Item6, Item7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
item_4 = ListItem(List=flatten(join), Index=0, Wrap=True)  # -> Item, Item1, Item2, Item3, Item4, Item5
list_item = ListItem(List=ghpython_script_3.filenames, Index=0, Wrap=True)

crv = Curve([item_2.Item, item_2.Item4, item_2.Item5])
crv_2 = Curve([item_2.Item2, item_2.Item3, item_2.Item1])

curve = Curve([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])
curve_2 = Curve([item_3.Item1, item_3.Item3])
crv_3 = Curve(item_4.Item)
crv_4 = Curve([item_4.Item2, item_4.Item3, item_4.Item1])
curve_3 = Curve([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])
curve_4 = Curve([item_3.Item2, item_3.Item])
panel_9 = Panel(ghpython_script_3.filenames)
number_slider_3 = Slider(1, range=0..1)
curve_5 = Curve(item_3.Item1)
demesh_2 = DeconstructMesh(Mesh=mesh_6)  # -> Vertices, Faces, Colours, Normals

crv_5 = Curve(curve_2)
crv_6 = Curve(curve_4)

curve_display = CSharpScript(Curve=crv_5, Width=Slider(7.82, range=0..20), Colour=ColourSwatch(SwatchColor=RGB(135, 26, 26)))  # inputs Curve: Curve, Width: Int32, Colour: Color, Dash: String
# ---------- curve_display: C# ----------
    if (Curve == null) return;
    if (Width <= 0) return;

    double[] pattern = ParseDashPattern(Dash);
    IEnumerable<Curve> segments = ApplyDashPattern(Curve, pattern);

    _clip = BoundingBox.Union(_clip, Curve.GetBoundingBox(false));
    foreach (Curve segment in segments)
    {
      _curves.Add(segment);
      _colors.Add(Colour);
      _widths.Add(Width);
    }
# ---------- curve_display: C# additional code ----------
  /// <summary>
  /// Parse a dash pattern.
  /// </summary>
  /// <param name="pattern">Pattern to parse.</param>
  /// <returns>Array of dashes and gaps.</returns>
  private double[] ParseDashPattern(string pattern)
  {
    if (string.IsNullOrWhiteSpace(pattern))
      return null;

    string[] fragments = pattern.Split(new char[] {' '});
    if (fragments == null || fragments.Length == 0)
      return null;

    double[] values = new double[fragments.Length];
    for (int i = 0; i < fragments.Length; i++)
    {
      double v;
      if (!double.TryParse(fragments[i], out v))
        throw new Exception(fragments[i] + " is a not a valid number.");

      if (v <= 0.0)
        throw new Exception("Dashes or gaps must have a strictly positive length.");

      values[i] = v;
    }

    return values;
  }
  /// <summary>
  /// Apply a dash+gap pattern to a curve.
  /// </summary>
  private IEnumerable<Curve> ApplyDashPattern(Curve curve, double[] pattern)
  {
    if (pattern == null || pattern.Length == 0)
      return new Curve[] { curve };

    double curveLength = curve.GetLength();
    List<Curve> dashes = new List<Curve>();

    double offset0 = 0.0;
    int index = 0;
    while(true)
    {
      // Get the current dash length.
      double dashLength = pattern[index++];
      if (index >= pattern.Length)
        index = 0;

      // Compute the offset of the current dash from the curve start.
      double offset1 = offset0 + dashLength;
      if (offset1 > curveLength)
        offset1 = curveLength;

      // Solve the curve parameters at the current dash start and end.
      double t0, t1;
      curve.LengthParameter(offset0, out t0);
      curve.LengthParameter(offset1, out t1);

      Curve dash = curve.Trim(t0, t1);
      if (dash != null)
        dashes.Add(dash);

      // Get the current gap length.
      double gapLength = pattern[index++];
      if (index >= pattern.Length)
        index = 0;

      // Set the start of the next dash to be the end of the current
      // dash + the length of the adjacent gap.
      offset0 = offset1 + gapLength;

      // Abort when we've reached the end of the curve.
      if (offset0 >= curveLength)
        break;
    }

    return dashes;
  }

  private BoundingBox _clip;
  private readonly List<Curve> _curves = new List<Curve>();
  private readonly List<Color> _colors = new List<Color>();
  private readonly List<int> _widths = new List<int>();

  /// <summary>
  /// This method will be called once every solution, before any calls to RunScript.
  /// </summary>
  public override void BeforeRunScript()
  {
    _clip = BoundingBox.Empty;
    _curves.Clear();
    _colors.Clear();
    _widths.Clear();
  }

  /// <summary>
  /// Return a BoundingBox that contains all the geometry you are about to draw.
  /// </summary>
  public override BoundingBox ClippingBox
  {
    get { return _clip; }
  }
  /// <summary>
  /// Draw all wires and points in this method.
  /// </summary>
  public override void DrawViewportWires(IGH_PreviewArgs args)
  {
    for (int i = 0; i < _curves.Count; i++)
      args.Display.DrawCurve(_curves[i], _colors[i], _widths[i]);
  }
# ---------- end curve_display ----------

curve_middle = CurveMiddle(Curve=crv_5)
curve_middle_2 = CurveMiddle(Curve=crv_6)
list_item_2 = ListItem(List=csloadslicer.paths, Index=0, Wrap=True)
mesh_7 = Mesh([<mesh referenced from the Rhino model> x4])
list_length_2 = ListLength(List=flatten(csloadslicer.paths))
item_5 = ListItem(List=flatten(join), Index=0, Wrap=True)  # -> Item, Item1, Item2, Item3, Item4, Item5
relay = Relay()

paths = Curve(simplify(csloadslicer.paths))
all_points = Point(csloadslicer.all_points)
mesh_8 = Mesh(csloadslicer.mesh)

mesh_9 = Mesh()
volume_2 = Volume(Geometry=mesh_9)  # -> Volume, Centroid

pull = PullPoint(Point=demesh_2.Vertices, Geometry=crv_5, ClosestOnly=True)  # -> ClosestPoint, Distance
dist = Distance(PointA=demesh_2.Vertices, PointB=pull.ClosestPoint)
smaller = SmallerThan(FirstNumber=dist, SecondNumber="0.001")  # -> SmallerThan, OrEqualTo
index = ItemIndex(List=demesh_2.Vertices, Item=demesh_2.Vertices)
dispatch = Dispatch(List=index, DispatchPattern=smaller.SmallerThan)  # -> ListA, ListB
dispatch_2 = Dispatch(List=demesh_2.Vertices, DispatchPattern=smaller.SmallerThan)  # -> ListA, ListB
pt = Point(dispatch_2.ListA)
int = Integer(dispatch.ListA)

pull_2 = PullPoint(Point=demesh_2.Vertices, Geometry=crv_6, ClosestOnly=True)  # -> ClosestPoint, Distance
dist_2 = Distance(PointA=demesh_2.Vertices, PointB=pull_2.ClosestPoint)
smaller_2 = SmallerThan(FirstNumber=dist_2, SecondNumber="0.001")  # -> SmallerThan, OrEqualTo
index_2 = ItemIndex(List=demesh_2.Vertices, Item=demesh_2.Vertices)
dispatch_3 = Dispatch(List=index_2, DispatchPattern=smaller_2.SmallerThan)  # -> ListA, ListB
dispatch_4 = Dispatch(List=demesh_2.Vertices, DispatchPattern=smaller_2.SmallerThan)  # -> ListA, ListB
pt_2 = Point(dispatch_4.ListA)
int_2 = Integer(dispatch_3.ListA)

pi = Pi(Factor=1)
curve_6 = Curve(csloadslicer.paths)
crv_7 = Curve([item_5.Item2, item_5.Item3, item_5.Item1])

mesh_normals = Vector(csloadprintpoints.mesh_normals)
layer_heights = Number(csloadprintpoints.layer_heights)
up_vectors = Vector(csloadprintpoints.up_vectors)
points = Point(csloadprintpoints.points)
frames = Plane(csloadprintpoints.frames)
cpts = Point(csloadprintpoints.closest_support)

frames_2 = Plane(frames)
pflip = FlipPlane(Plane=frames_2, ReverseX=False, ReverseY=False, SwapAxes=True)

print_planes = Plane(pflip)
tool_mesh = Mesh(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)

# ----
# Tool Visualization
# Note: This is only an example. The actual tool orientation depends on the definition of the frame of your tool
number_slider_4 = Slider(902, range=0..7500)
tool_origin = Panel("""0
0
99.507""")
cstoolviz = CsToolViz(origin_coords=tool_origin, mesh=tool_mesh, planes=print_planes, index=number_slider_4)  # -> out, mesh, passed_path; inputs origin_coords: list, mesh: Mesh, planes: list, index: Int32
# ---------- cstoolviz: Python ----------
"""
Example visualization of tool motion during the print.

"""

import compas_slicer_ghpython.visualization as gh_compas_slicer
gh_compas_slicer = reload(gh_compas_slicer)

if origin_coords and mesh and planes and (index or index==0):
    mesh, passed_path = gh_compas_slicer.tool_visualization(origin_coords, mesh, planes, index)
else:
    gh_compas_slicer.missing_input()
# ---------- end cstoolviz ----------

mesh_normals_2 = Vector(mesh_normals)
points_2 = Point(points)
section = Curve(rectangle.Rectangle)

data_dam = DataDam(DataDataA=cstoolviz.passed_path, BufferDelay=10000000, BufferMode=0)
data_dam_2 = DataDam(DataDataA=cstoolviz.mesh, BufferDelay=10000000, BufferMode=0)

blend_radiuses = Number(csloadprintpoints.blend_radiuses)
extruder_toggles = Number(csloadprintpoints.extruder_toggles)
velocities = Number(csloadprintpoints.velocities)
wait_times = Number(csloadprintpoints.wait_times)

# ----
# Ligthweight Path Visualization
number_slider_5 = Slider(3.9, range=0..10)
extruder_toggles_2 = Number(extruder_toggles)
all_points_2 = Point(points)
cslightpathviz = CsLightPathViz(
    points=all_points_2,
    extruder_toggles=extruder_toggles_2,
    domain_start=Slider(0, range=0..100),
    domain_end=Slider(1263, range=0..2000),
    pipe_diameter=number_slider_5)  # -> out, print_path_pipes, travel_path_lines; inputs points: list of Point3d, extruder_toggles: list of Boolean, domain_start: Int32, domain_end: Int32
# ---------- cslightpathviz: Python ----------
"""
Creates a lightweight visualization of the print paths. Segments with extruder_toggle=True are visualized as pipes, 
segments with extruder_toggle=False are visualized as lines.
Loads files from the 'output' folder.

"""

import compas_slicer_ghpython.visualization as gh_compas_slicer
gh_compas_slicer = reload(gh_compas_slicer)

pipe_resolution = 14

if points:
    
    # assign default values to parameters where possible. 
    if not extruder_toggles:
        extruder_toggles = [False for i in range(len(points))]
    if not domain_start:
        domain_start = 0
    if not domain_end:
        domain_end = len(points)
    if not pipe_diameter:
        pipe_diameter = 2.0
        
    print_path_pipes, travel_path_lines = \
        gh_compas_slicer.lightweight_path_visualization(points, extruder_toggles, pipe_diameter, pipe_resolution)
    
else:
    gh_compas_slicer.missing_input()
# ---------- end cslightpathviz ----------

# ----
# Render Path Visualization
toggle = BooleanToggle(False)
extruder_toggles_3 = Number(extruder_toggles)
layer_heights_2 = Number(layer_heights)
up_vectors_2 = Vector(up_vectors)

python = CsRenderPathViz(
    points=points_2,
    mesh_normals=mesh_normals_2,
    layer_heights=layer_heights_2,
    up_vectors=up_vectors_2,
    extruder_toggles=extruder_toggles_3,
    cross_section=section,
    planar_printing=toggle,
    compute=Toggle(False))  # -> out, loft_surfaces, travel_path_lines; inputs points: list of Point3d, mesh_normals: list of Vector3d, layer_heights: list, up_vectors: list of Vector3d, extruder_toggles: list of Boolean, cross_section: Curve, planar_printing: Boolean, compute: Boolean
# ---------- python: Python ----------
"""
Creates a render visualization of the print paths with loft surfaces where extruder_toggle=True.
For large number of points, this can take a while to compute, so keep it turned off unless you need it.
Loads files from the 'output' folder.

"""

import compas_slicer_ghpython.visualization as gh_compas_slicer
gh_compas_slicer = reload(gh_compas_slicer)

pipe_resolution = 14

if points and mesh_normals and layer_heights and extruder_toggles and cross_section:
    if compute:
        loft_surfaces, travel_path_lines = \
            gh_compas_slicer.render_path_visualization(points, mesh_normals, layer_heights, up_vectors, extruder_toggles, cross_section, planar_printing)
    else:
        print('Compute is set to False')
else:
    gh_compas_slicer.missing_input()
# ---------- end python ----------
panel_10 = Panel(curve_5)
# Visualize geodesic distances
crv_8 = Curve(item_5.Item)
explode_tree = ExplodeTree(Data=paths)
panel_11 = Panel(csloadprintpoints.out)
panel_12 = Panel(crv_5)
panel_13 = Panel(paths)
multiplication = Multiplication(A=pi, B=Slider(0.25, range=0..1), C="-1", D=number_slider_3)
data_dam_3 = DataDam(DataDataA=volume_2.Centroid, BufferDelay=10000000, BufferMode=0)
yz_plane = YZPlane(Origin=data_dam_3)
item_6 = ListItem(List=flatten(join), Index=0, Wrap=True)  # -> Item, Item1, Item2, Item3, Item4, Item5

# ---- group: Color output
geo = Geometry(cslightpathviz.print_path_pipes)
geo_2 = Geometry(cslightpathviz.travel_path_lines)
preview = CustomPreview(Geometry=geo, Material=ColourSwatch(SwatchColor=RGB(199, 199, 199)))
preview_2 = CustomPreview(Geometry=geo_2, Material=ColourSwatch(SwatchColor=RGB(255, 156, 36)))

geo_3 = Geometry(python.travel_path_lines)
geo_4 = Geometry(python.loft_surfaces)
preview_3 = CustomPreview(Geometry=geo_4, Material=ColourSwatch(SwatchColor=RGB(222, 222, 222)))
preview_4 = CustomPreview(Geometry=geo_3, Material=ColourSwatch(SwatchColor=RGB(255, 156, 36)))

# ----
geo_5 = Geometry(cstoolviz.passed_path)
mesh_10 = Mesh(cstoolviz.mesh)
preview_5 = CustomPreview(Geometry=mesh_10, Material=ColourSwatch(SwatchColor=RGB(171, 171, 171)))
preview_6 = CustomPreview(Geometry=geo_5, Material=ColourSwatch(SwatchColor=RGB(255, 156, 36)))

geo_6 = Geometry(data_dam)
amplitude = Amplitude(Vector=up_vectors, Amplitude=layer_heights)
geo_7 = Geometry(data_dam_2)
ln = Line(StartPoint=points, EndPoint=cpts)
vdis = VectorDisplay(Anchor=points, Vector=expr("x", amplitude))
mesh_edges = MeshEdges(Mesh=mesh_7)  # -> NakedEdges, InteriorEdges, NonManifoldEdges
panel_15 = Panel("0.5")
colour_rgb_f = ColourRGBF(Alpha=1, Red="0.7", Green=0, Blue=0)
rotate = Rotate(Geometry=mesh_9, Angle=multiplication, Plane=yz_plane)  # -> Geometry, Transform
ghpython_script_5 = GhPythonScript(x=paths)  # -> out, a, b; inputs x: tree
# ---------- ghpython_script_5: Python ----------
import ghpythonlib.components as gh
import Grasshopper.DataTree as dt
a=dt[object]()
b=dt[object]()
for i in x.Paths:
    de_ph=gh.DeconstructPath(i)
    if de_ph[-1]==0:
        a.AddRange(x.Branch(i),gh.ConstructPath(de_ph[:-1]))
    else:
        b.AddRange(x.Branch(i),gh.ConstructPath(de_ph[:-1]))
# ---------- end ghpython_script_5 ----------
crv_9 = Curve([item_6.Item3, item_6.Item2])
param_viewer = ParamViewer(csloadslicer.paths)
crv_10 = Curve([item_6.Item1, item_6.Item])
xy_plane = XYPlane(Origin=data_dam_3)

# ---- group: Press button to save json files
button_5 = Button()

# ----
transform = Transform(Geometry=data_dam_3, Transform=rotate.Transform)

# ---- group: Select parameter
num = Number(layer_heights)

# ----
panel_16 = Panel(up_vectors)
subtraction_3 = Subtraction(A="1", B="0.6")
line = Line(reverse(mesh_edges.NakedEdges))
multiplication_2 = Multiplication(A=multiplication, B="0.6")
colour_rgb_f_2 = ColourRGBF(Alpha=1, Red=0, Green="1", Blue=0)

custom_preview = CustomPreview(Geometry=ghpython_script_5.a, Material=colour_rgb_f_2)
custom_preview_2 = CustomPreview(Geometry=ghpython_script_5.b, Material=colour_rgb_f)

# ---- group: Visualize parameter with text
tag_offset = Slider(1, range=0..100)
pdecon = Deconstruct(Point=points)  # -> XComponent, YComponent, ZComponent
addition_2 = Addition(A=pdecon.ZComponent, B=tag_offset)
pt_3 = ConstructPoint(XCoordinate=pdecon.XComponent, YCoordinate=pdecon.YComponent, ZCoordinate=addition_2)
tag = TextTag(Location=pt_3, Text=num, Colour=ColourSwatch(SwatchColor=RGB(50, 130, 186)))

# ---- group: Visualize parameter with color
bnd_2 = Bounds(Numbers=num)
avr = Average(Input=num)
dedomain = DeconstructDomain(Domain=bnd_2)  # -> Start, End
average = Panel(avr)
gradient = Gradient(
    LowerLimit=dedomain.Start,
    UpperLimit=dedomain.End,
    Parameter=num,
    stops=[0: RGB(0, 128, 0), 0.5: RGB(255, 255, 0), 1: RGB(255, 0, 0)])
pt_4 = Point(points)
cloud = CloudDisplay(Points=pt_4, Colours=gradient, Size=Slider(1.72, range=0..10), SpriteType=1)

# ----
number_slider_6 = Slider(0, range=0..1)
vector_length = VectorLength(Vector=csloadslicer.gras)
join_curves = JoinCurves(Curves=flatten(line), Preserve=False)
xz_plane = XZPlane(Origin=data_dam_3)
rotate_2 = Rotate(Geometry=rotate.Geometry, Angle=multiplication_2, Plane=xy_plane)  # -> Geometry, Transform
transform_2 = Transform(Geometry=transform, Transform=rotate_2.Transform)
multiplication_3 = Multiplication(A=multiplication, B=subtraction_3, C="-1")
save_to_json = GhPythonScript(save=button_5, list=int_2, path=py, folder_name=data_2, json_name="boundaryHIGH.json")  # -> out; inputs save: Boolean, list: list
# ---------- save_to_json: Python ----------
"""
Saves to Json

"""

import compas_slicer_ghpython.visualization as gh_compas_slicer
gh_compas_slicer = reload(gh_compas_slicer)


if save:
    if list and path and folder_name and json_name:
        gh_compas_slicer.save_json_file(list, path, folder_name, json_name)
    else:
        gh_compas_slicer.missing_input()
else:
    print('No files were saved because save = False')
# ---------- end save_to_json ----------
save_to_json_2 = GhPythonScript(save=button_5, list=int, path=py, folder_name=data_2, json_name="boundaryLOW.json")  # -> out; inputs save: Boolean, list: list; same code as save_to_json
min = Panel(dedomain.Start)
max = Panel(dedomain.End)
rotate_up_down = Slider(1, range=-1..1)
multiplication_4 = Multiplication(A=multiplication, B="2")
list_item_3 = ListItem(List=flatten(paths), Index=-1, Wrap=True)
list_length_3 = ListLength()
division_3 = Division(A="1/30", B=vector_length)
amplitude_2 = Amplitude(Vector=csloadslicer.gras, Amplitude=division_3)
panel_17 = Panel(save_to_json)
panel_18 = Panel(save_to_json_2)
rotate_3 = Rotate(Geometry=rotate_2.Geometry, Angle=multiplication_4, Plane=xz_plane)  # -> Geometry, Transform
transform_3 = Transform(Geometry=transform_2, Transform=rotate_3.Transform)
explode_tree_2 = ExplodeTree()  # -> Branch0, Branch1, Branch2, Branch3, Branch4, Branch5, Branch6, Branch7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
pipe = Pipe(Curve=join_curves, Radius=1, Caps=0)  # -> flatten(Pipe)
multiplication_5 = Multiplication(A="0.25*pi")
multiplication_6 = Multiplication(A="-0.25*pi", B=rotate_up_down)
box = Box(list_item_3)
multiplication_7 = Multiplication(A="0.5", B=number_slider_3)
subtraction_4 = Subtraction(A="1", B=multiplication_7)
number_slider_7 = Slider(1, range=0..1)
number_slider_8 = Slider(1, range=0..1)
curve_7 = Curve([explode_tree_2.Branch5, explode_tree_2.Branch3, explode_tree_2.Branch2, explode_tree_2.Branch1])
volume_3 = Volume(Geometry=box)  # -> Volume, Centroid
vector_display = VectorDisplay(Anchor=csloadslicer.pts, Vector=amplitude_2)
multiplication_8 = Multiplication(A=number_slider_3, B="601")
multiplication_9 = Multiplication(A=multiplication_6)
scale = Scale(Geometry=rotate_3.Geometry, Center=data_dam_3, Factor=subtraction_4)  # -> Geometry, Transform
data_dam_4 = DataDam(DataDataA=volume_3.Centroid, BufferDelay=10000000, BufferMode=0)
transform_4 = Transform(Geometry=transform_3, Transform=scale.Transform)
unit_x = UnitX(Factor=multiplication_8)
point = Point(<point referenced from the Rhino model>)
xy_plane_2 = XYPlane(Origin=point)
rotate_4 = Rotate(Angle=multiplication_5, Plane=xy_plane_2)  # -> Geometry, Transform
rotate_5 = Rotate(Geometry=paths, Angle=multiplication_5, Plane=xy_plane_2)  # -> Geometry, Transform
number_slider_9 = Slider(1, range=0..1)
multiplication_10 = Multiplication(A="2*pi", B=number_slider_8)

# ----
# Load Vectors
panel_19 = Panel("gradient.json")
csloadjsonvectors = CsLoadJsonVectors(recompute=Button(), json_name=panel_19, path=py, folder_name=data_2)  # -> out, vectors; inputs recompute: Boolean
# ---------- csloadjsonvectors: Python ----------
"""
Loads a json file from the 'output' folder, 
that stores a vector field in the format: 
data['0']=[x0,y0,z0], ...,  data['N']=[xN,yN,zN]


"""

import compas_slicer_ghpython.visualization as gh_compas_slicer
gh_compas_slicer = reload(gh_compas_slicer)

if json_name and path and folder_name:
    vectors = gh_compas_slicer.load_json_vectors(path, folder_name, json_name)
else:
    gh_compas_slicer.missing_input()
# ---------- end csloadjsonvectors ----------
demesh_3 = DeconstructMesh(Mesh=mesh_5)  # -> Vertices, Faces, Colours, Normals
vdis_2 = VectorDisplay(Anchor=demesh_3.Vertices, Vector=csloadjsonvectors.vectors)

# ----
# Load Points
button_6 = Button()
csloadjsonpoints = CsLoadJsonPoints(recompute=button_6, json_name="pts_boundary_HIGH_0.json", path=py, folder_name=data_2)  # -> out, points; inputs recompute: Boolean
# ---------- csloadjsonpoints: Python ----------
"""
Loads a json file that stores a dictionary of N points in the format: 
data['0']=[x0,y0,z0], ...,  data['N']=[xN,yN,zN]


"""

import compas_slicer_ghpython.visualization as gh_compas_slicer
gh_compas_slicer = reload(gh_compas_slicer)

if json_name and path and folder_name:
    points = gh_compas_slicer.load_json_points(path, folder_name, json_name)
else:
    gh_compas_slicer.missing_input()
# ---------- end csloadjsonpoints ----------
pt_5 = Point(csloadjsonpoints.points)

move = Move(Geometry=scale.Geometry, Motion=unit_x)  # -> Geometry, Transform
yz_plane_2 = YZPlane(Origin=point)
graph_mapper = GraphMapper(number_slider_8, x0=0, x1=1, y0=0, y1=0.7, Ox=0.5016233921, Oy=0.9975550175, Px=0, Py=0, container_name="Parabola")
rotate_6 = Rotate(Geometry=rotate_4.Geometry, Angle=expr("x*(-1)", multiplication_9), Plane=yz_plane_2)  # -> Geometry, Transform
panel_20 = Panel(data_dam_4)
transform_5 = Transform(Geometry=transform_4, Transform=move.Transform)
yz_plane_3 = YZPlane(Origin=transform_5)
rotate_7 = Rotate(Geometry=mesh_7, Angle=multiplication_3, Plane=yz_plane_3)  # -> Geometry, Transform
transform_6 = Transform(Geometry=pipe, Transform=rotate_7.Transform)
custom_preview_3 = CustomPreview(
    Geometry=transform_6,
    Material={diffuse=RGB(221, 160, 221), emission=RGB(66, 48, 66), shine=0.5, specular=RGB(255, 255, 255), transparency=0})  # disabled
point_2 = Point(data_dam_4)
vector_xyz = VectorXYZ(XComponent=0, YComponent="-1", ZComponent="1")  # -> Vector, Length
volume_4 = Volume(Geometry=rotate_6.Geometry)  # -> Volume, Centroid
panel_21 = Panel("0")
rotate_8 = Rotate(Geometry=rotate_5.Geometry, Angle=expr("x*(-1)", multiplication_9), Plane=yz_plane_2)  # -> Geometry, Transform
csfindfilenames_2 = CsFindFilenames(recompute=Button(), starts_with="all_field_gradient_low", ends_with=".json", path=py, folder_name=data_2)  # -> out, filenames, n; inputs recompute: Boolean; same code as csfindfilenames
panel_22 = Panel(graph_mapper)
csfindfilenames_3 = CsFindFilenames(recompute=Button(), starts_with="all_field_gradient_high", ends_with=".json", path=py, folder_name=data_2)  # -> out, filenames, n; inputs recompute: Boolean; same code as csfindfilenames
vector_xyz_2 = VectorXYZ(XComponent="-0.032254", YComponent="0.0279263", ZComponent="-0.00182352")  # -> Vector, Length
csfindfilenames_4 = CsFindFilenames(recompute=Button(), starts_with="cutted_mesh", ends_with=".obj", path=py, folder_name=data_2)  # -> out, filenames, n; inputs recompute: Boolean; same code as csfindfilenames
csfindfilenames_5 = CsFindFilenames(recompute=Button(), starts_with="layer_height_vertices", ends_with=".json", path=py, folder_name=data_2)  # -> out, filenames, n; inputs recompute: Boolean; same code as csfindfilenames
csfindfilenames_6 = CsFindFilenames(recompute=Button(), starts_with="dist_low", ends_with=".json", path=py, folder_name=data_2)  # -> out, filenames, n; inputs recompute: Boolean; same code as csfindfilenames
csfindfilenames_7 = CsFindFilenames(recompute=Button(), starts_with="scalar_field", ends_with=".json", path=py, folder_name=data_2)  # -> out, filenames, n; inputs recompute: Boolean; same code as csfindfilenames
csfindfilenames_8 = CsFindFilenames(recompute=Button(), starts_with="dist_high", ends_with=".json", path=py, folder_name=data_2)  # -> out, filenames, n; inputs recompute: Boolean; same code as csfindfilenames
list_item_4 = ListItem(List=csfindfilenames_4.filenames, Index=0, Wrap=True)
cull_index = CullIndex(List=csfindfilenames_4.filenames, Indices="0", Wrap=True)
rotate_3d = Rotate3D(Geometry=rotate_6.Geometry, Angle=multiplication_10, Center=volume_4.Centroid, Axis=vector_xyz.Vector)  # -> Geometry, Transform
point_3 = Point(Point(50, -50, 58.333))
unit_x_2 = UnitX(Factor=1)

# ----
# Mesh modification Data
# Load vertex indices
panel_23 = Panel("inverse_neighbors39.json")
number_slider_10 = Slider(2.61, range=0..20)
merge_2 = Merge(Data1=panel_23, Data2="edited_key30.json", Data3="sorted_key499.json")
csloadjsondata_2 = CsLoadJsonData(recompute=Button(), json_name=merge_2, path=py, folder_name=data_2)  # -> out, simplify(data); inputs recompute: Boolean; same code as csloadjsondata
csinterpolation = CsInterpolation(recompute=Button(), json_name="inverse_neighbors_org_normal0.json", path=py, folder_name=data_2)  # -> out, influences_list; inputs recompute: Boolean
# ---------- csinterpolation: Python ----------
"""
Interpolation of the two distance fields that are loaded from the 'output' folder. 

"""
#asdf
import compas_slicer_ghpython.visualization as gh_compas_slicer
import Grasshopper.DataTree as dt
import Grasshopper.Kernel.Data.GH_Path as ph
import ghpythonlib.components as gh
gh_compas_slicer = reload(gh_compas_slicer)
influences=dt[object]()

def veky_influence(veky,influences_list):
    influence_list = influences_list[veky]
    return influence_list

influences_list = gh_compas_slicer.influence_fields(path, folder_name, json_name)
for i,v in enumerate(influences_list):
    influences_list[i]=gh.VectorXYZ(v[0],v[1],v[2])[0]
# ---------- end csinterpolation ----------
load_mesh_5 = GhPythonScript(recompute=Button(), path=py, folder=data_2, filename="edited_mesh42.obj")  # -> out, mesh; same code as load_mesh_2
branch = TreeBranch(Tree=csloadjsondata_2.data, Path="2", MaintainPaths=True)
branch_2 = TreeBranch(Tree=csloadjsondata_2.data, Path="0", MaintainPaths=True)
branch_3 = TreeBranch(Tree=csloadjsondata_2.data, Path="1", MaintainPaths=True)
mesh_11 = Mesh(load_mesh_5.mesh)
demesh_4 = DeconstructMesh(Mesh=mesh_11)  # -> Vertices, Faces, Colours, Normals
list_item_5 = ListItem(List=demesh_4.Vertices, Index=[2966, 14662], Wrap=True)
data_dam_5 = DataDam(DataDataA=demesh_4.Vertices, BufferDelay=10000000, BufferMode=0)
data_dam_6 = DataDam(DataDataA=demesh_4.Vertices, BufferDelay=10000000, BufferMode=0)
item_7 = ListItem(List=demesh_4.Vertices, Index=branch, Wrap=True)
item_8 = ListItem(List=demesh_4.Vertices, Index=branch_2, Wrap=True)
item_9 = ListItem(List=demesh_4.Vertices, Index=branch_3, Wrap=True)
vector_display_2 = VectorDisplay(Anchor=item_8, Vector=expr("x*10", csinterpolation.influences_list))
cloud_2 = CloudDisplay(Points=item_8, Colours=ColourSwatch(SwatchColor=RGB(107, 235, 52)), Size=number_slider_10, SpriteType=1)
cloud_3 = CloudDisplay(Points=item_9, Colours=ColourSwatch(SwatchColor=RGB(52, 52, 235)), Size=number_slider_10, SpriteType=1)
cloud_4 = CloudDisplay(Points=item_7, Colours=ColourSwatch(SwatchColor=RGB(255, 0, 0)), Size=number_slider_10, SpriteType=1)

load_mesh_6 = GhPythonScript(recompute=Button(), path=py, folder=data_2, filename=cull_index)  # -> out, mesh; same code as load_mesh
panel_24 = Panel("-0.032254    0.0279263  -0.00182352")
panel_25 = Panel(csfindfilenames_4.filenames)
rotate_3d_2 = Rotate3D(Geometry=rotate_3d.Geometry, Angle=graph_mapper, Center=volume_4.Centroid, Axis=unit_x_2)  # -> Geometry, Transform
curve_middle_3 = CurveMiddle(Curve=crv_6)
curve_middle_4 = CurveMiddle(Curve=crv_5)
boolean_toggle = BooleanToggle(False)  # disabled
mesh_12 = Mesh(load_mesh_6.mesh)
list_length_4 = ListLength(List=mesh_12)
division_4 = Division(A="1", B=list_length_4)
csinterpolation_2 = CsInterpolation(
    recompute=Button(),
    compute=Toggle(False),
    json_name="offset_distances_low_.json",
    path=py,
    folder_name=data_2,
    frame_number="101")  # -> out, influences_list, simplify(nested_influences); inputs recompute: Boolean, frame_number: Int32
# ---------- csinterpolation_2: Python ----------
"""
Interpolation of the two distance fields that are loaded from the 'output' folder. 

"""
#asdf
#import Grasshopper.DataTree as dt
#import Grasshopper.Kernel.Data.GH_Path as ph
#import ghpythonlib.components as gh
import visualization as loading
loading=reload(loading)

import time
start_time=time.time()
#influences=dt[object]()
#nested_influences=dt[object]()

start_with,end_with=json_name.split('.')
names=[]
for frame in range(0,frame_number):
    
    json_name=start_with+str(frame)+'.'+end_with

    names.append(json_name)
print names
if compute:
    nested_influences=loading.load_nested_influence(path,folder_name,names)
print(time.time()-start_time)
# ---------- end csinterpolation_2 ----------
data_dam_7 = DataDam(DataDataA=rotate_4.Geometry, BufferDelay=10000000, BufferMode=0)
series = Series(Start=0, Step=division_4, Count=list_length_4)
panel_26 = Panel("near_field.json")  # disabled
point_4 = Point(<point referenced from the Rhino model>)
button_7 = Button()  # disabled
data_dam_8 = DataDam(DataDataA=csinterpolation_2.nested_influences, BufferDelay=10000000, BufferMode=0)
merge_3 = Merge(Data1=rotate_3d.Transform, Data2=rotate_3d_2.Transform, Data3=rotate_6.Transform)
list_item_6 = ListItem(List=merge_3, Index=0, Wrap=True)  # -> Item, Item1, Item2
transform_7 = Transform(Geometry=rotate_8.Geometry, Transform=list_item_6.Item)
button_8 = Button()
panel_27 = Panel(mesh_12)
transform_8 = Transform(Geometry=transform_7, Transform=list_item_6.Item1)
button_9 = Button()  # disabled
button_10 = Button()  # disabled
button_11 = Button()  # disabled
csinterpolation_3 = CsInterpolation(recompute=Button(), json_name="fail_edge.json", path=py, folder_name=data_2)  # -> out, b, a; inputs recompute: Boolean
# ---------- csinterpolation_3: Python ----------
"""
Interpolation of the two distance fields that are loaded from the 'output' folder. 

"""
#asdf
import compas_slicer_ghpython.visualization as gh_compas_slicer
import Grasshopper.DataTree as dt
import Grasshopper.Kernel.Data.GH_Path as ph
import ghpythonlib.components as gh
gh_compas_slicer = reload(gh_compas_slicer)
influences=dt[object]()

def veky_influence(veky,influences_list):
    influence_list = influences_list[veky]
    return influence_list

influences_list = gh_compas_slicer.influence_fields(path, folder_name, json_name)
a=[x[0] for x in influences_list]
b=[x[1] for x in influences_list]
# ---------- end csinterpolation_3 ----------
button_12 = Button()  # disabled
button_13 = Button()  # disabled
colour_hsl = ColourHSL(Alpha="1", Hue=series, Saturation=1, Luminance=0.5)  # -> simplify(graft(Colour))
demesh_5 = DeconstructMesh(Mesh=mesh_12)  # -> simplify(Vertices), simplify(Faces), Colours, Normals
csinterpolation_4 = CsInterpolation(recompute=Button(), json_name="igldistances_target_low_voxel.json", path=py, folder_name=data_2)  # -> out, influences; inputs recompute: Boolean
# ---------- csinterpolation_4: Python ----------
"""
Interpolation of the two distance fields that are loaded from the 'output' folder. 

"""
#asdf
import compas_slicer_ghpython.visualization as gh_compas_slicer
import Grasshopper.DataTree as dt
import Grasshopper.Kernel.Data.GH_Path as ph
gh_compas_slicer = reload(gh_compas_slicer)
influences=dt[object]()

def veky_influence(veky,influences_list):
    influence_list = influences_list[veky]
    return influence_list

influences_list = gh_compas_slicer.influence_fields(path, folder_name, json_name)
VN=len(influences_list)
#print(influences_list)
for veky in range(VN):
    tree_path=ph(veky)
    influence=veky_influence(veky,influences_list)
    print(influence)
    influences.AddRange(influence,tree_path)
# ---------- end csinterpolation_4 ----------
multiplication_11 = Multiplication(A=vector_xyz_2.Vector, B="20")
csinterpolation_5 = CsInterpolation(recompute=Button(), json_name="igldistances_target_high_voxel.json", path=py, folder_name=data_2)  # -> out, influences; inputs recompute: Boolean; same code as csinterpolation_4
csinterpolation_6 = CsInterpolation(recompute=Button(), json_name="igldistances_saddle.json", path=py, folder_name=data_2)  # -> out, influences; inputs recompute: Boolean; same code as csinterpolation_4
ghpython_script_6 = GhPythonScript(frame=number_slider)  # -> out, influences; inputs nested_weights: tree
# ---------- ghpython_script_6: Python ----------
__author__ = "Ke Dao"
__version__ = "2024.10.01"

import rhinoscriptsyntax as rs
import ghpythonlib.components as gh
import Grasshopper.DataTree as dt
import Grasshopper.Kernel.Data.GH_Path as ph
influences=dt[object]()
for tree_path in nested_weights.Paths:
    path_de=gh.DeconstructPath(tree_path)
    if path_de[0]==frame:
        influences.AddRange(nested_weights.Branch(tree_path),ph(path_de[1]))
# ---------- end ghpython_script_6 ----------
csinterpolation_7 = CsInterpolation(recompute=button_9, json_name="in_meshdistances_target_low_voxel.json", path=py, folder_name=data_2)  # -> out, influences; inputs recompute: Boolean; disabled; same code as csinterpolation_4
csinterpolation_8 = CsInterpolation(recompute=button_11, json_name="in_meshdistances_target_high_voxel.json", path=py, folder_name=data_2)  # -> out, influences; inputs recompute: Boolean; disabled; same code as csinterpolation_4
csinterpolation_9 = CsInterpolation(recompute=button_10, json_name="in_meshdistances_saddle.json", path=py, folder_name=data_2)  # -> out, influences; inputs recompute: Boolean; disabled; same code as csinterpolation_4
csinterpolation_10 = CsInterpolation(recompute=Button(), json_name="distancess_notflip_High.json", path=py, folder_name=data_2)  # -> out, influences; inputs recompute: Boolean; disabled
# ---------- csinterpolation_10: Python ----------
"""
Interpolation of the two distance fields that are loaded from the 'output' folder. 

"""
#asdf
import visualization as gh_compas_slicer
import Grasshopper.DataTree as dt
import Grasshopper.Kernel.Data.GH_Path as ph
gh_compas_slicer = reload(gh_compas_slicer)
influences=dt[object]()

def veky_influence(veky,influences_list):
    influence_list = influences_list[veky]
    return influence_list

influences = gh_compas_slicer.load_influence(path, folder_name, json_name)
# ---------- end csinterpolation_10 ----------
csinterpolation_11 = CsInterpolation(
    recompute=Button(),
    compute=Toggle(False),
    json_name="scalar_field.josn",
    path=py,
    folder_name=data_2,
    frame_number="101")  # -> out, influences_list, nested_influences; inputs recompute: Boolean, frame_number: Int32; disabled
# ---------- csinterpolation_11: Python ----------
"""
Interpolation of the two distance fields that are loaded from the 'output' folder. 

"""
#asdf
import compas_slicer_ghpython.visualization as gh_compas_slicer
import Grasshopper.DataTree as dt
import Grasshopper.Kernel.Data.GH_Path as ph
gh_compas_slicer = reload(gh_compas_slicer)
influences=dt[object]()
nested_influences=dt[object]()
def veky_influence(veky,influences_list):
    influence_list = influences_list[veky]
    return influence_list

start_with,end_with=json_name.split('.')
if compute:
    for frame in range(0,frame_number):
        
        json_name=start_with+str(frame)+'.'+end_with
        print(json_name)
        influences_list = gh_compas_slicer.influence_fields(path, folder_name, json_name)
        nested_influences.AddRange(influences_list,ph(frame))
# ---------- end csinterpolation_11 ----------
csinterpolation_12 = CsInterpolation(recompute=button_12, json_name=panel_26, path=py, folder_name=data_2)  # -> out, influences; inputs recompute: Boolean; disabled
# ---------- csinterpolation_12: Python ----------
"""
Interpolation of the two distance fields that are loaded from the 'output' folder. 

"""
#asdf
import compas_slicer_ghpython.visualization as gh_compas_slicer
import Grasshopper.DataTree as dt
import Grasshopper.Kernel.Data.GH_Path as ph
gh_compas_slicer = reload(gh_compas_slicer)
influences=dt[object]()

def veky_influence(veky,influences_list):
    influence_list = influences_list[veky]
    return influence_list

influences_list = gh_compas_slicer.influence_fields(path, folder_name, json_name)
VN=len(influences_list)
#print(influences_list)
for veky in range(VN):
    tree_path=ph(veky)
    influence=veky_influence(veky,influences_list)
    print(influence)
    try:
        influences.AddRange(influence,tree_path)
    except:
        influences.Add(influence,tree_path)
# ---------- end csinterpolation_12 ----------
reverse_list = ReverseList(List=curve_middle_3)  # disabled
reverse_list_2 = ReverseList(List=curve_middle_4)  # disabled
panel_28 = Panel("1")
csinterpolation_13 = CsInterpolation(recompute=Button(), json_name="distancess_Low.json", path=py, folder_name=data_2)  # -> out, influences; inputs recompute: Boolean; disabled; same code as csinterpolation_10
csinterpolation_14 = CsInterpolation(recompute=Button(), json_name="distancess_notflip_Low.json", path=py, folder_name=data_2)  # -> out, influences; inputs recompute: Boolean; disabled; same code as csinterpolation_10
csinterpolation_15 = CsInterpolation(recompute=Button(), json_names=csfindfilenames_3.filenames, path=py, folder_name=data_2)  # -> out, influences; inputs recompute: Boolean, json_names: list
# ---------- csinterpolation_15: Python ----------
"""
Interpolation of the two distance fields that are loaded from the 'output' folder. 

"""
#asdf
import compas_slicer_ghpython.visualization as gh_compas_slicer
import Grasshopper.DataTree as dt
import Grasshopper.Kernel.Data.GH_Path as ph
import ghpythonlib.components as gh
gh_compas_slicer = reload(gh_compas_slicer)
influences=dt[object]()

def veky_influence(veky,influences_list):
    #print(influences_list)
    veky=str(veky)
    influence_list = influences_list[veky]
    influence_list = gh.VectorXYZ(influence_list[0],influence_list[1],influence_list[2],)[0]
    return influence_list
for file_id,json_name in enumerate(json_names):
    influences_list = gh_compas_slicer.influence_fields(path, folder_name, json_name)
    VN=len(influences_list)
    #print(influences_list)
    for veky in range(VN):
        tree_path=ph(file_id,veky)
        influence=veky_influence(veky,influences_list)
        #print(influence)
        if isinstance(influence,list):
            influences.AddRange(influence,tree_path)
        else:
            influences.Add(influence,tree_path)
# ---------- end csinterpolation_15 ----------
csinterpolation_16 = CsInterpolation(recompute=button_13, json_name="graph.json", path=py, folder_name=data_2)  # -> out, influences; inputs recompute: Boolean; disabled; same code as csinterpolation_4
csinterpolation_17 = CsInterpolation(recompute=Button(), json_name="scalar_field.json", path=py, folder_name=data_2)  # -> out, influences_list; inputs recompute: Boolean
# ---------- csinterpolation_17: Python ----------
"""
Interpolation of the two distance fields that are loaded from the 'output' folder. 

"""
#asdf
import visualization as gh_compas_slicer
import Grasshopper.DataTree as dt
import Grasshopper.Kernel.Data.GH_Path as ph
gh_compas_slicer = reload(gh_compas_slicer)
influences=dt[object]()

def veky_influence(veky,influences_list):
    influence_list = influences_list[veky]
    return influence_list

influences_list = gh_compas_slicer.load_influence(path, folder_name, json_name)
# ---------- end csinterpolation_17 ----------
number_slider_11 = Slider(1.08, range=0..20)  # disabled
panel_29 = Panel(csinterpolation_2.nested_influences)
csinterpolation_18 = CsInterpolation(recompute=Button(), json_names=csfindfilenames_2.filenames, path=py, folder_name=data_2)  # -> out, influences; inputs recompute: Boolean, json_names: list; same code as csinterpolation_15
mesh_13 = Mesh(mesh_4)
colour_rgb_f_3 = ColourRGBF(Alpha="0.3", Red="1", Green="1", Blue="1")
curve_8 = Curve(paths)
number_slider_12 = Slider(20, range=0..20)  # disabled
panel_31 = Panel("0.01")
panel_32 = Panel(series)
demesh_6 = DeconstructMesh(Mesh=mesh_13)  # -> Vertices, Faces, Colours, Normals
conmesh = ConstructMesh(Vertices=demesh_5.Vertices, Faces=demesh_5.Faces, Colours=colour_hsl)
list_item_7 = ListItem(List=csinterpolation_4.influences, Index=0, Wrap=True)  # -> flatten(Item), flatten(Item1)
csinterpolation_19 = CsInterpolation(recompute=Button(), path=py, folder_name=data_2)  # -> out, up, low, DU, DL; inputs recompute: Boolean
# ---------- csinterpolation_19: Python ----------
"""
Interpolation of the two distance fields that are loaded from the 'output' folder. 

"""
#asdf
import visualization as vis

vis = reload(vis)
up,low,DU,DL=vis.load_mesh_topo(path,folder_name)
# ---------- end csinterpolation_19 ----------
panel_33 = Panel(csinterpolation_19.low)
csinterpolation_20 = CsInterpolation(recompute=Button(), json_name="distancess_notflip_High.json", path=py, folder_name=data_2)  # -> out, influences; inputs recompute: Boolean; disabled; same code as csinterpolation_4
csinterpolation_21 = CsInterpolation(recompute=Button(), json_names=csfindfilenames_5.filenames, path=py, folder_name=data_2)  # -> out, influences; inputs recompute: Boolean, json_names: list
# ---------- csinterpolation_21: Python ----------
"""
Interpolation of the two distance fields that are loaded from the 'output' folder. 

"""
#asdf
import visualization as gh_compas_slicer
import Grasshopper.DataTree as dt
import Grasshopper.Kernel.Data.GH_Path as ph
gh_compas_slicer = reload(gh_compas_slicer)
influences=dt[object]()

def veky_influence(veky,influences_list):
    influence_list = influences_list[veky]
    return influence_list

influences = gh_compas_slicer.load_nested_data(path, folder_name, json_names)

#print(influences_list)


print(influences)
# ---------- end csinterpolation_21 ----------
flatten_tree = FlattenTree(Tree=csinterpolation_21.influences, Path="{0}")
panel_34 = Panel(csinterpolation_21.influences)
ghpython_script_7 = GhPythonScript(x=flatten_tree)  # -> out, a; inputs x: list
# ---------- ghpython_script_7: Python ----------
import statistics
x=[xi for xi in x if isinstance(xi,float)]
a=statistics.mean(x)
# ---------- end ghpython_script_7 ----------
subtraction_5 = Subtraction(A=csinterpolation_21.influences, B=ghpython_script_7.a)
division_5 = Division(A=subtraction_5, B=flatten_tree)
distances = Number(division_5)
bnd_3 = Bounds(Numbers=distances)
dedomain_2 = DeconstructDomain(Domain=bnd_3)  # -> Start, End
gradient_2 = Gradient(
    LowerLimit="-0.3",
    UpperLimit="0.3",
    Parameter=distances,
    stops=[0: RGB(128, 0, 0), 0.102: RGB(255, 128, 0), 0.202: RGB(255, 192, 128), 0.303: RGB(255, 255, 0), 0.4: RGB(255, 255, 128), 0.498: RGB(0, 255, 0), 0.604: RGB(128, 255, 255), 0.7: RGB(0, 255, 255), 0.8: RGB(128, 192, 255), 0.901: RGB(0, 128, 255), 1: RGB(0, 0, 255)])
gradient_3 = Gradient(
    LowerLimit=dedomain_2.Start,
    UpperLimit=dedomain_2.End,
    Parameter=distances,
    stops=[0: RGB(128, 0, 0), 0.161: RGB(255, 128, 0), 0.303: RGB(192, 64, 0), 0.433: RGB(255, 255, 128), 0.561: RGB(0, 255, 255), 0.71: RGB(192, 255, 192), 0.845: RGB(143, 188, 139), 1: RGB(153, 180, 209), 1: RGB(75, 107, 169)])
csinterpolation_22 = CsInterpolation(recompute=Button(), json_names=csfindfilenames_8.filenames, path=py, folder_name=data_2)  # -> out, influences; inputs recompute: Boolean, json_names: list; same code as csinterpolation_21
flip_matrix = FlipMatrix(Data=ghpython_script_6.influences)  # -> simplify(Data)
csinterpolation_23 = CsInterpolation(recompute=Button(), json_names=csfindfilenames_6.filenames, path=py, folder_name=data_2)  # -> out, influences; inputs recompute: Boolean, json_names: list; same code as csinterpolation_21
trim_tree = TrimTree(Tree=csinterpolation_15.influences, Depth=1)
list_item_8 = ListItem(List=[csinterpolation_6.influences, csinterpolation_5.influences, csinterpolation_4.influences], Index=0, Wrap=False)  # -> flatten(Item), flatten(Item1), flatten(Item2), flatten(Item3), flatten(Item4), flatten(Item5), flatten(Item6), flatten(Item7)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
tree_branch = TreeBranch(Tree=csinterpolation_11.nested_influences, Path=construct_path, MaintainPaths=True)  # disabled
trim_tree_2 = TrimTree(Tree=csinterpolation_18.influences, Depth=1)
list_item_9 = ListItem(List=[csinterpolation_9.influences, csinterpolation_8.influences, csinterpolation_7.influences], Index=0, Wrap=False)  # -> flatten(Item), flatten(Item1), flatten(Item2), flatten(Item3), flatten(Item4), flatten(Item5), flatten(Item6), flatten(Item7)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; disabled
custom_preview_4 = CustomPreview(Geometry=rotate_3d_2.Geometry, Material=colour_rgb_f_3)  # disabled
param_viewer_2 = ParamViewer(csinterpolation_2.nested_influences)
split_argb = SplitARGB(Colour=gradient_2)  # -> Alpha, Red, Green, Blue
panel_35 = Panel(csinterpolation_5.influences)
panel_36 = Panel(csinterpolation_17.influences_list)
path_mapper = PathMapper(source="{A;B;C}", target="{A;C;B}")  # disabled
list_item_10 = ListItem(List=conmesh, Index=0, Wrap=True)
panel_37 = Panel("0")  # disabled
flatten_tree_2 = FlattenTree(Tree=csinterpolation_12.influences, Path="{0}")  # disabled
list_item_11 = ListItem(List=flip_matrix, Index=0, Wrap=True)  # -> Item, Item1
explode_tree_3 = ExplodeTree(Data=trim_tree)  # -> Branch0, Branch1, Branch2
explode_tree_4 = ExplodeTree(Data=csinterpolation_14.influences)  # -> Branch0, Branch1, Branch2, Branch3, Branch4, Branch5, Branch6
explode_tree_5 = ExplodeTree(Data=csinterpolation_20.influences)  # -> Branch0, Branch1; disabled
explode_tree_6 = ExplodeTree(Data=gradient_2)  # -> Branch0, Branch1, Branch2, Branch3
panel_38 = Panel(list_item_8.Item12)
deconstruct_mesh = DeconstructMesh(Mesh=mesh_4)  # -> Vertices, Faces, Colours, Normals
explode_tree_7 = ExplodeTree(Data=trim_tree_2)  # -> Branch0, Branch1, Branch2
trim_tree_3 = TrimTree(Depth=1)
field_generation = Slider(1, range=0..1)
trim_tree_4 = TrimTree(Depth=1)
mesh_14 = Mesh(mesh_12)
list_length_5 = ListLength(List=demesh_6.Vertices)
trim_tree_5 = TrimTree(Tree=path_mapper, Depth=1)  # disabled
colour_rgb_f_4 = ColourRGBF(Alpha=Slider(0.5, range=0..1), Red=split_argb.Red, Green=split_argb.Green, Blue=split_argb.Blue)
explode_tree_8 = ExplodeTree(Data=csinterpolation_21.influences)  # -> Branch0, Branch1, Branch2, Branch3
explode_tree_9 = ExplodeTree(Data=csinterpolation_22.influences)  # -> Branch0, Branch1, Branch2, Branch3
list_item_12 = ListItem(List=merge_3, Index=0, Wrap=True)  # -> Item, Item1
explode_tree_10 = ExplodeTree(Data=csinterpolation_23.influences)  # -> Branch0, Branch1, Branch2, Branch3
ghpython_script_8 = GhPythonScript(x=csinterpolation_17.influences_list, y=Slider(1, range=0..1))  # -> out, a; inputs x: list
# ---------- ghpython_script_8: Python ----------
x_max=max(x)
a=[]
limit=y*x_max
for i in x:
    if i < limit:
        x_out=i
    else:
        x_out=x_max
    a.append(x_out)
# ---------- end ghpython_script_8 ----------
relay_2 = Relay()  # disabled
relay_3 = Relay()  # disabled
flatten_tree_3 = FlattenTree(Tree=list_item_11.Item, Path="{0}")
flatten_tree_4 = FlattenTree(Tree=list_item_11.Item1, Path="{0}")
list_length_6 = ListLength(List=demesh_6.Vertices)
param_viewer_3 = ParamViewer(conmesh)
seperate = Slider(1, range=0..1)
list_item_13 = ListItem(List=csinterpolation_8.influences, Index=0, Wrap=True)  # -> flatten(Item); disabled
panel_39 = Panel(csinterpolation_8.influences)  # disabled
deconstruct = Deconstruct(Point=deconstruct_mesh.Vertices)  # -> XComponent, YComponent, ZComponent
vector_xyz_3 = VectorXYZ(XComponent="-600", YComponent=0, ZComponent=0)  # -> Vector, Length
angle = Angle(VectorA=explode_tree_3.Branch0, VectorB=explode_tree_7.Branch0)  # -> Angle, Reflex
trim_tree_6 = TrimTree(Tree=csinterpolation_17.influences_list, Depth=1)
vector_display_3 = VectorDisplay(Anchor=demesh_6.Vertices, Vector=expr("x*7", explode_tree_3.Branch0))
panel_40 = Panel("600")
ghpython_script_9 = GhPythonScript(x=list_item_9.Item15)  # -> out, a; inputs x: list; disabled
# ---------- ghpython_script_9: Python ----------
a=min(x)
# ---------- end ghpython_script_9 ----------
list_item_14 = ListItem(List=mesh_14, Index=0, Wrap=True)  # -> Item, Item1, Item2, Item3, Item4, Item5
demesh_7 = DeconstructMesh(Mesh=mesh_14)  # -> Vertices, Faces, Colours, Normals
ghpython_script_10 = GhPythonScript(x=explode_tree_9.Branch2, y=explode_tree_10.Branch2)  # -> out, a; inputs x: list, y: list
# ---------- ghpython_script_10: Python ----------
a=[]
for i,j in zip(x,y):
    if i==0:
        a.append(j)
    if j==0:
        a.append(i)
# ---------- end ghpython_script_10 ----------
ghpython_script_11 = GhPythonScript(x=ghpython_script_10.a)  # -> out, a; inputs x: list
# ---------- ghpython_script_11: Python ----------
import statistics
a=statistics.median(x)
# ---------- end ghpython_script_11 ----------
ghpython_script_12 = GhPythonScript(x=list_item_8.Item10, y=field_generation)  # -> out, a; inputs x: list
# ---------- ghpython_script_12: Python ----------
x_max=max(x)
a=[]
limit=y*x_max
print x_max
for i in x:
    if i < limit:
        x_out=i
    else:
        x_out=1500
    a.append(x_out)
# ---------- end ghpython_script_12 ----------
vector_display_4 = VectorDisplay(Anchor=demesh_6.Vertices, Vector=expr("x*7", explode_tree_7.Branch0))
ghpython_script_13 = GhPythonScript(x=list_item_8.Item11, y=field_generation)  # -> out, a; inputs x: list
# ---------- ghpython_script_13: Python ----------
x_max=max(x)
a=[]
limit=y*x_max
for i in x:
    if i < limit:
        x_out=i
    else:
        x_out=1500
    a.append(x_out)
# ---------- end ghpython_script_13 ----------
conmesh_2 = ConstructMesh(Vertices=demesh_7.Vertices, Faces=demesh_7.Faces, Colours=colour_rgb_f_4)
panel_41 = Panel(ghpython_script_11.a)
distances_2 = Number(csinterpolation_17.influences_list)
distances_3 = Number(trim_tree_6)
distances_4 = Number(flatten_tree_2)  # disabled
distances_5 = Number(list_item_13)  # disabled
subtraction_6 = Subtraction(A=flatten_tree_3, B=ghpython_script_12.a)
subtraction_7 = Subtraction(A=flatten_tree_4, B=ghpython_script_13.a)
distances_6 = Number(angle.Angle)
panel_42 = Panel("4")  # disabled

# ----
# Find files by name
button_14 = Button()
csfindfilenames_9 = CsFindFilenames(recompute=button_14, starts_with="curved_slicer_", ends_with=".json", path=py, folder_name=data_2)  # -> out, filenames, n; inputs recompute: Boolean; same code as csfindfilenames
filenames = Panel(csfindfilenames_9.filenames)
number_of_files = Panel(csfindfilenames_9.n)

abs = Absolute(Value=distances_2)
number_slider_13 = Slider(1, range=0..1)
abs_2 = Absolute(Value=distances_3)
abs_3 = Absolute(Value=distances_4)  # disabled
abs_4 = Absolute(Value=distances_5)  # disabled
multiplication_12 = Multiplication(A=seperate, B="5")
distances_7 = Number(csinterpolation_19.up)
distances_8 = Number(csinterpolation_19.low)
distances_9 = Number(explode_tree_4.Branch0)
panel_43 = Panel(distances_7)
distances_10 = Number(explode_tree_4.Branch1)
distances_11 = Number()  # disabled
distances_12 = Number(csinterpolation_19.DU)
distances_13 = Number(explode_tree_5.Branch0)  # disabled
distances_14 = Number(csinterpolation_19.DL)
distances_15 = Number(explode_tree_5.Branch1)  # disabled
panel_44 = Panel(ghpython_script_12.a)
distances_16 = Number(abs)
distances_17 = Number(flatten_tree_3)
distances_18 = Number(abs_2)
mesh_15 = Mesh(mesh_5)
distances_19 = Number(flatten_tree_4)
distances_20 = Number(abs_3)  # disabled
mesh_16 = Mesh(mesh_5)  # disabled
distances_21 = Number(subtraction_6)
distances_22 = Number(abs_4)  # disabled
distances_23 = Number(subtraction_7)
mesh_17 = Mesh(mesh_5)  # disabled
gradient_4 = Gradient(
    LowerLimit="0",
    UpperLimit="pi",
    Parameter=distances_6,
    stops=[0: RGB(255, 255, 0), 0.474: RGB(255, 0, 0), 1: RGB(0, 255, 255)])
number_slider_14 = Slider(1, range=0..1)
data_dam_9 = DataDam(DataDataA=[flatten_tree_3, flatten_tree_4, list_item_8.Item10, list_item_8.Item11], BufferDelay=10000000, BufferMode=0)
ghpython_script_14 = GhPythonScript(x=seperate)  # -> out, a, b
# ---------- ghpython_script_14: Python ----------
if x < 0.25:
    a=x*4
    b=0
else:
    a=1
    b=(x-0.25)/0.75
# ---------- end ghpython_script_14 ----------
bnd_4 = Bounds(Numbers=distances_16)
bnd_5 = Bounds(Numbers=distances_20)  # disabled
uinon = Slider(0.3, range=0..1)
bnd_6 = Bounds(Numbers=distances_22)  # disabled
abs_5 = Absolute(Value=distances_17)
abs_6 = Absolute(Value=distances_19)
abs_7 = Absolute(Value=distances_21)
abs_8 = Absolute(Value=distances_9)
abs_9 = Absolute(Value=distances_23)
abs_10 = Absolute(Value=distances_10)
vector_xyz_4 = VectorXYZ(XComponent="600", YComponent="-600", ZComponent="-50")  # -> Vector, Length
abs_11 = Absolute(Value=distances_13)  # disabled
abs_12 = Absolute(Value=distances_15)  # disabled
abs_13 = Absolute(Value=distances_11)  # disabled
dedomain_3 = DeconstructDomain(Domain=bnd_4)  # -> Start, End
dedomain_4 = DeconstructDomain(Domain=bnd_5)  # -> Start, End; disabled
bounds_2 = Bounds(Numbers=[0, 1])
split_argb_2 = SplitARGB(Colour=gradient_4)  # -> Alpha, Red, Green, Blue
dedomain_5 = DeconstructDomain(Domain=bnd_6)  # -> Start, End; disabled
bnd_7 = Bounds(Numbers=data_dam_9)
point_5 = Point([<point referenced from the Rhino model> x15])
distances_24 = Number(abs_5)
distances_25 = Number(abs_6)
distances_26 = Number(distances_7)
distances_27 = Number(distances_8)
distances_28 = Number(abs_7)
mesh_18 = Mesh(load_mesh_3.mesh)
distances_29 = Number(abs_8)
distances_30 = Number(abs_9)
mesh_19 = Mesh(mesh_5)
distances_31 = Number(abs_10)
mesh_20 = Mesh(mesh_5)
mesh_21 = Mesh(load_mesh_3.mesh)
bnd_8 = Bounds(Numbers=[distances_28, distances_30])
distances_32 = Number(distances_12)
distances_33 = Number(abs_11)  # disabled
mesh_22 = Mesh(load_mesh_3.mesh)
mesh_23 = Mesh(mesh_5)  # disabled
mesh_24 = Mesh(load_mesh_3.mesh)
distances_34 = Number(distances_14)
distances_35 = Number(abs_12)  # disabled
number_slider_15 = Slider(1, range=0..1)  # disabled
mesh_25 = Mesh(mesh_5)  # disabled
distances_36 = Number(abs_13)  # disabled
mesh_26 = Mesh(mesh_5)  # disabled
gradient_5 = Gradient(
    LowerLimit=dedomain_3.Start,
    UpperLimit=dedomain_3.End,
    Parameter=distances_18,
    stops=[0: RGB(128, 0, 0), 0: RGB(128, 0, 0), 0.142: RGB(255, 99, 71), 0.413: RGB(255, 228, 181), 0.532: RGB(143, 188, 139), 0.656: RGB(152, 251, 152), 0.77: RGB(135, 206, 235), 0.887: RGB(176, 196, 222), 1: RGB(70, 130, 180)])
gradient_6 = Gradient(
    LowerLimit=dedomain_3.Start,
    UpperLimit=dedomain_3.End,
    Parameter=distances_16,
    stops=[0: RGB(128, 0, 0), 0.102: RGB(255, 128, 0), 0.202: RGB(255, 192, 128), 0.303: RGB(255, 255, 0), 0.4: RGB(255, 255, 128), 0.498: RGB(0, 255, 0), 0.604: RGB(128, 255, 255), 0.7: RGB(0, 255, 255), 0.8: RGB(128, 192, 255), 0.901: RGB(0, 128, 255), 1: RGB(0, 0, 255)])
mesh_27 = Mesh(mesh_5)
gradient_7 = Gradient(
    LowerLimit=dedomain_3.Start,
    UpperLimit=dedomain_3.End,
    Parameter=distances_18,
    stops=[0: RGB(128, 0, 0), 0: RGB(128, 0, 0), 0.145: RGB(0, 192, 0), 0.276: RGB(128, 255, 128), 0.413: RGB(192, 0, 192), 0.532: RGB(192, 0, 0), 0.656: RGB(0, 255, 255), 0.77: RGB(255, 128, 0), 0.887: RGB(255, 128, 128), 1: RGB(70, 130, 180)])
multiplication_13 = Multiplication(A="0.25*pi", B=number_slider_13)
gradient_8 = Gradient(
    LowerLimit=dedomain_4.Start,
    UpperLimit=dedomain_4.End,
    Parameter=distances_20,
    stops=[0: RGB(128, 0, 0), 0: RGB(128, 0, 0), 0.145: RGB(188, 143, 143), 0.276: RGB(255, 99, 71), 0.413: RGB(255, 228, 181), 0.532: RGB(143, 188, 139), 0.656: RGB(152, 251, 152), 0.77: RGB(135, 206, 235), 0.887: RGB(176, 196, 222), 1: RGB(70, 130, 180)])  # disabled
gradient_9 = Gradient(
    LowerLimit=dedomain_5.Start,
    UpperLimit=dedomain_5.End,
    Parameter=distances_22,
    stops=[0: RGB(128, 0, 0), 0.161: RGB(255, 128, 0), 0.303: RGB(192, 64, 0), 0.433: RGB(255, 255, 128), 0.561: RGB(128, 128, 0), 0.71: RGB(192, 255, 192), 0.845: RGB(143, 188, 139), 1: RGB(153, 180, 209), 1: RGB(75, 107, 169)])  # disabled
bnd_9 = Bounds(Numbers=distances_26)
gradient_10 = Gradient(
    LowerLimit=dedomain_4.Start,
    UpperLimit=dedomain_4.End,
    Parameter=distances_20,
    stops=[0: RGB(148, 0, 211), 0.103: RGB(128, 0, 0), 0.198: RGB(188, 143, 143), 0.303: RGB(255, 99, 71), 0.407: RGB(255, 228, 181), 0.504: RGB(143, 188, 139), 0.604: RGB(152, 251, 152), 0.704: RGB(135, 206, 235), 0.803: RGB(176, 196, 222), 0.901: RGB(70, 130, 180)])  # disabled
demesh_8 = DeconstructMesh(Mesh=mesh_15)  # -> Vertices, Faces, Colours, Normals
bnd_10 = Bounds(Numbers=distances_27)
data_dam_10 = DataDam(DataDataA=bnd_8, BufferDelay=10000000, BufferMode=0)
demesh_9 = DeconstructMesh(Mesh=mesh_16)  # -> Vertices, Faces, Colours, Normals; disabled
bnd_11 = Bounds(Numbers=distances_29)
bnd_12 = Bounds(Numbers=distances_31)
demesh_10 = DeconstructMesh(Mesh=mesh_17)  # -> Vertices, Faces, Colours, Normals; disabled
bnd_13 = Bounds(Numbers=distances_32)
bnd_14 = Bounds(Numbers=distances_33)  # disabled
bnd_15 = Bounds(Numbers=distances_34)
bnd_16 = Bounds(Numbers=distances_35)  # disabled
ghpython_script_15 = GhPythonScript(x=distances_24, y=distances_25, z=uinon)  # -> out, a, b
# ---------- ghpython_script_15: Python ----------
__author__ = "Ke Dao"
__version__ = "2024.10.03"

import rhinoscriptsyntax as rs
if z!=0:
    if x>y:
        a=1-z
        b=1
    else:
        a=1
        b=1-z
else:
    a=1
    b=1
# ---------- end ghpython_script_15 ----------
bnd_17 = Bounds(Numbers=distances_36)  # disabled
dedomain_6 = DeconstructDomain(Domain=bnd_7)  # -> Start, End
colour_rgb_f_5 = ColourRGBF(Alpha="0.6", Red=split_argb_2.Red, Green=split_argb_2.Green, Blue=split_argb_2.Blue)
ghpython_script_16 = GhPythonScript(x=distances_24)  # -> out, a
# ---------- ghpython_script_16: Python ----------
if x>1450:
    a=0.7
else:
    a=1
# ---------- end ghpython_script_16 ----------
remap_numbers = RemapNumbers(Value=distances_26, Source=bnd_9, Target=bounds_2)  # -> Mapped, Clipped
ghpython_script_17 = GhPythonScript(x=distances_25)  # -> out, a; same code as ghpython_script_16
dedomain_7 = DeconstructDomain(Domain=bnd_9)  # -> Start, End
dedomain_8 = DeconstructDomain(Domain=bnd_10)  # -> Start, End
dedomain_9 = DeconstructDomain(Domain=bnd_11)  # -> Start, End
panel_45 = Panel(dedomain_9.Start)
dedomain_10 = DeconstructDomain(Domain=bnd_12)  # -> Start, End
dedomain_11 = DeconstructDomain(Domain=bnd_13)  # -> Start, End
dedomain_12 = DeconstructDomain(Domain=bnd_14)  # -> Start, End; disabled
split_argb_3 = SplitARGB(Colour=gradient_6)  # -> Alpha, Red, Green, Blue
dedomain_13 = DeconstructDomain(Domain=bnd_15)  # -> Start, End
dedomain_14 = DeconstructDomain(Domain=bnd_16)  # -> Start, End; disabled
split_argb_4 = SplitARGB(Colour=gradient_10)  # -> Alpha, Red, Green, Blue; disabled
conmesh_3 = ConstructMesh(Vertices=demesh_10.Vertices, Faces=demesh_10.Faces, Colours=gradient_9)  # disabled
dedomain_15 = DeconstructDomain(Domain=bnd_17)  # -> Start, End; disabled
gradient_11 = Gradient(
    LowerLimit=dedomain_6.Start,
    UpperLimit=dedomain_6.End,
    Parameter=distances_24,
    stops=[0: RGB(245, 245, 245), 1: RGB(255, 0, 0)])
gradient_12 = Gradient(
    LowerLimit=dedomain_6.Start,
    UpperLimit=dedomain_6.End,
    Parameter=distances_24,
    stops=[0: RGB(245, 245, 245), 0: RGB(41, 170, 163), 1: RGB(255, 0, 0)])
gradient_13 = Gradient(
    LowerLimit=dedomain_6.Start,
    UpperLimit=dedomain_6.End,
    Parameter=distances_24,
    stops=[0: RGB(245, 245, 245), 1: RGB(255, 0, 0)])
gradient_14 = Gradient(
    LowerLimit=dedomain_6.Start,
    UpperLimit=dedomain_6.End,
    Parameter=distances_25,
    stops=[0: RGB(245, 245, 245), 0.991: RGB(0, 0, 255)])
dedomain_16 = DeconstructDomain(Domain=data_dam_10)  # -> Start, End
gradient_15 = Gradient(
    LowerLimit=dedomain_16.Start,
    UpperLimit=dedomain_16.End,
    Parameter=distances_28,
    stops=[0: RGB(224, 224, 224), 1: RGB(64, 64, 64)])
gradient_16 = Gradient(
    LowerLimit=dedomain_16.Start,
    UpperLimit=dedomain_16.End,
    Parameter=distances_30,
    stops=[0: RGB(224, 224, 224), 1: RGB(64, 64, 64)])
gradient_17 = Gradient(
    LowerLimit=dedomain_7.Start,
    UpperLimit=dedomain_7.End,
    Parameter=distances_26,
    stops=[0: RGB(128, 0, 0), 0.161: RGB(255, 128, 0), 0.303: RGB(192, 64, 0), 0.433: RGB(255, 255, 128), 0.561: RGB(128, 128, 0), 0.71: RGB(192, 255, 192), 0.845: RGB(143, 188, 139), 1: RGB(153, 180, 209), 1: RGB(75, 107, 169)])
gradient_18 = Gradient(
    LowerLimit=dedomain_8.Start,
    UpperLimit=dedomain_8.End,
    Parameter=distances_27,
    stops=[0: RGB(128, 0, 0), 0.161: RGB(255, 128, 0), 0.303: RGB(192, 64, 0), 0.433: RGB(255, 255, 128), 0.561: RGB(128, 128, 0), 0.71: RGB(192, 255, 192), 0.845: RGB(143, 188, 139), 1: RGB(153, 180, 209), 1: RGB(75, 107, 169)])
gradient_19 = Gradient(
    LowerLimit=dedomain_9.Start,
    UpperLimit=dedomain_9.End,
    Parameter=distances_29,
    stops=[0: RGB(255, 0, 0), 0.161: RGB(255, 128, 0), 0.303: RGB(192, 64, 0), 0.433: RGB(255, 255, 128), 0.561: RGB(128, 128, 0), 0.71: RGB(192, 255, 192), 0.845: RGB(143, 188, 139), 1: RGB(153, 180, 209), 1: RGB(75, 107, 169)])
gradient_20 = Gradient(
    LowerLimit=dedomain_10.Start,
    UpperLimit=dedomain_10.End,
    Parameter=distances_31,
    stops=[0: RGB(128, 0, 0), 0.161: RGB(255, 128, 0), 0.303: RGB(192, 64, 0), 0.433: RGB(255, 255, 128), 0.561: RGB(128, 128, 0), 0.71: RGB(192, 255, 192), 0.845: RGB(143, 188, 139), 1: RGB(153, 180, 209), 1: RGB(75, 107, 169)])
gradient_21 = Gradient(
    LowerLimit=dedomain_11.Start,
    UpperLimit=dedomain_11.End,
    Parameter=distances_32,
    stops=[0: RGB(128, 0, 0), 0.161: RGB(255, 128, 0), 0.303: RGB(192, 64, 0), 0.433: RGB(255, 255, 128), 0.561: RGB(128, 128, 0), 0.71: RGB(192, 255, 192), 0.845: RGB(143, 188, 139), 1: RGB(153, 180, 209), 1: RGB(75, 107, 169)])
gradient_22 = Gradient(
    LowerLimit=dedomain_12.Start,
    UpperLimit=dedomain_12.End,
    Parameter=distances_33,
    stops=[0: RGB(128, 0, 0), 0.161: RGB(255, 128, 0), 0.303: RGB(192, 64, 0), 0.433: RGB(255, 255, 128), 0.561: RGB(128, 128, 0), 0.71: RGB(192, 255, 192), 0.845: RGB(143, 188, 139), 1: RGB(153, 180, 209), 1: RGB(75, 107, 169)])  # disabled
demesh_11 = DeconstructMesh(Mesh=mesh_21)  # -> Vertices, Faces, Colours, Normals
gradient_23 = Gradient(
    LowerLimit=dedomain_15.Start,
    UpperLimit=dedomain_15.End,
    Parameter=distances_36,
    stops=[0: RGB(0, 128, 0), 0.474: RGB(255, 255, 255), 1: RGB(255, 0, 0)])  # disabled
gradient_24 = Gradient(
    LowerLimit=dedomain_13.Start,
    UpperLimit=dedomain_13.End,
    Parameter=distances_34,
    stops=[0: RGB(0, 0, 0), 0.39: RGB(0, 255, 0), 0.74: RGB(0, 0, 255), 1: RGB(255, 0, 255), 1: RGB(75, 107, 169)])
gradient_25 = Gradient(
    LowerLimit=dedomain_14.Start,
    UpperLimit=dedomain_14.End,
    Parameter=distances_35,
    stops=[0: RGB(128, 0, 0), 0.161: RGB(255, 128, 0), 0.303: RGB(192, 64, 0), 0.433: RGB(255, 255, 128), 0.561: RGB(128, 128, 0), 0.71: RGB(192, 255, 192), 0.845: RGB(143, 188, 139), 1: RGB(153, 180, 209), 1: RGB(75, 107, 169)])  # disabled
demesh_12 = DeconstructMesh(Mesh=mesh_18)  # -> Vertices, Faces, Colours, Normals
ghpython_script_18 = GhPythonScript(x=uinon)  # -> out, a, b
# ---------- ghpython_script_18: Python ----------
if x < 0.75:
    a=x*4/3
    b=0
else:
    a=1
    b=(x-0.75)/0.25
# ---------- end ghpython_script_18 ----------
demesh_13 = DeconstructMesh(Mesh=mesh_19)  # -> Vertices, Faces, Colours, Normals
demesh_14 = DeconstructMesh(Mesh=mesh_20)  # -> Vertices, Faces, Colours, Normals
conmesh_4 = ConstructMesh(Vertices=demesh_6.Vertices, Faces=demesh_6.Faces, Colours=colour_rgb_f_5)
demesh_15 = DeconstructMesh(Mesh=mesh_24)  # -> Vertices, Faces, Colours, Normals
demesh_16 = DeconstructMesh(Mesh=mesh_23)  # -> Vertices, Faces, Colours, Normals; disabled
demesh_17 = DeconstructMesh(Mesh=mesh_22)  # -> Vertices, Faces, Colours, Normals
demesh_18 = DeconstructMesh(Mesh=mesh_25)  # -> Vertices, Faces, Colours, Normals; disabled
demesh_19 = DeconstructMesh(Mesh=mesh_26)  # -> Vertices, Faces, Colours, Normals; disabled
colour_hsl_2 = ColourHSL(Alpha=1, Hue=remap_numbers.Clipped, Saturation="1", Luminance="0.7")
colour_rgb_f_6 = ColourRGBF(Alpha=Slider(0.868, range=0..1), Red=split_argb_3.Red, Green=split_argb_3.Green, Blue=split_argb_3.Blue)
colour_rgb_f_7 = ColourRGBF(Alpha=number_slider_15, Red=split_argb_4.Red, Green=split_argb_4.Green, Blue=split_argb_4.Blue)  # disabled
number_slider_16 = Slider(0.711, range=0..1)  # disabled
conmesh_5 = ConstructMesh(Vertices=demesh_12.Vertices, Faces=demesh_12.Faces, Colours=gradient_18)
conmesh_6 = ConstructMesh(Vertices=demesh_14.Vertices, Faces=demesh_14.Faces, Colours=gradient_20)
conmesh_7 = ConstructMesh(Vertices=demesh_16.Vertices, Faces=demesh_16.Faces, Colours=gradient_22)  # disabled
demesh_20 = DeconstructMesh(Mesh=mesh_27)  # -> Vertices, Faces, Colours, Normals
gradient_26 = Gradient(
    LowerLimit=dedomain_11.Start,
    UpperLimit=dedomain_11.End,
    Parameter=distances_32,
    stops=[0: RGB(0, 0, 0), 0.39: RGB(0, 255, 0), 0.74: RGB(0, 0, 255), 1: RGB(255, 0, 255), 1: RGB(75, 107, 169)])
conmesh_8 = ConstructMesh(Vertices=demesh_18.Vertices, Faces=demesh_18.Faces, Colours=gradient_25)  # disabled
multiplication_14 = Multiplication(A=vector_xyz_4.Vector, B=number_slider_13)
split_argb_5 = SplitARGB(Colour=gradient_23)  # -> Alpha, Red, Green, Blue; disabled
number_slider_17 = Slider(0.7, range=0..1)
number_slider_18 = Slider(1, range=0..1)
ghpython_script_19 = GhPythonScript(x=distances_24, y=distances_25, z="1")  # -> out, a, b; same code as ghpython_script_15
conmesh_9 = ConstructMesh(Vertices=demesh_11.Vertices, Faces=demesh_11.Faces, Colours=gradient_17)
conmesh_10 = ConstructMesh(Vertices=demesh_13.Vertices, Faces=demesh_13.Faces, Colours=gradient_19)
conmesh_11 = ConstructMesh(Vertices=demesh_8.Vertices, Faces=demesh_8.Faces, Colours=colour_rgb_f_6)
mesh_28 = Mesh(conmesh_11)
move_2 = Move(Geometry=[paths, conmesh_11], Motion=vector_xyz_3.Vector)  # -> Geometry, Transform
move_3 = Move(Geometry=[relay_3, relay_2, conmesh_11], Motion=vector_xyz_3.Vector)  # -> Geometry, Transform
move_4 = Move(Geometry=[paths, conmesh_11], Motion=vector_xyz_3.Vector)  # -> Geometry, Transform
list_item_15 = ListItem(List=flatten(move_4.Geometry), Index=-1, Wrap=True)
list_item_16 = ListItem(List=move_2.Geometry, Index=0, Wrap=True)
box_2 = Box(list_item_15)
volume_5 = Volume(Geometry=box_2)  # -> Volume, Centroid
data_dam_11 = DataDam(DataDataA=volume_5.Centroid, BufferDelay=10000000, BufferMode=0)
xy_plane_3 = XYPlane(Origin=data_dam_11)
rotate_9 = Rotate(Geometry=move_4.Geometry, Angle=multiplication_13, Plane=xy_plane_3)  # -> Geometry, Transform
yz_plane_4 = YZPlane(Origin=data_dam_11)
rotate_10 = Rotate(Geometry=rotate_9.Geometry, Angle=expr("x*(-1)", multiplication_13), Plane=yz_plane_4)  # -> Geometry, Transform
integer = Integer(ghpython_script_13.a)
integer_2 = Integer(ghpython_script_12.a)
split_argb_6 = SplitARGB(Colour=gradient_11)  # -> Alpha, Red, Green, Blue
split_argb_7 = SplitARGB(Colour=gradient_13)  # -> Alpha, Red, Green, Blue
conmesh_12 = ConstructMesh(Vertices=demesh_17.Vertices, Faces=demesh_17.Faces, Colours=gradient_24)
split_argb_8 = SplitARGB(Colour=gradient_14)  # -> Alpha, Red, Green, Blue
split_argb_9 = SplitARGB(Colour=gradient_15)  # -> Alpha, Red, Green, Blue
split_argb_10 = SplitARGB(Colour=gradient_16)  # -> Alpha, Red, Green, Blue
conmesh_13 = ConstructMesh(Vertices=demesh_9.Vertices, Faces=demesh_9.Faces, Colours=colour_rgb_f_7)  # disabled
conmesh_14 = ConstructMesh(Vertices=demesh_15.Vertices, Faces=demesh_15.Faces, Colours=gradient_26)
data_dam_12 = DataDam(DataDataA=conmesh_11, BufferDelay=10000000, BufferMode=0)  # disabled
data_dam_13 = DataDam(DataDataA=conmesh_11, BufferDelay=10000000, BufferMode=0)  # disabled
data_dam_14 = DataDam(DataDataA=conmesh_11, BufferDelay=10000000, BufferMode=0)  # disabled
data_dam_15 = DataDam(DataDataA=conmesh_11, BufferDelay=10000000, BufferMode=0)  # disabled
colour_rgb_f_8 = ColourRGBF(Alpha=number_slider_16, Red=split_argb_5.Red, Green=split_argb_5.Green, Blue=split_argb_5.Blue)  # disabled
colour_rgb_f_9 = ColourRGBF(Alpha=ghpython_script_19.b, Red=split_argb_8.Red, Green=split_argb_8.Green, Blue=split_argb_8.Blue)
colour_rgb_f_10 = ColourRGBF(Alpha=ghpython_script_19.a, Red=split_argb_6.Red, Green=split_argb_6.Green, Blue=split_argb_6.Blue)
move_5 = Move(Geometry=rotate_10.Geometry, Motion=multiplication_14)  # -> Geometry, Transform
unit_x_3 = UnitX(Factor="200")
colour_rgb_f_11 = ColourRGBF(Alpha=ghpython_script_17.a, Red=split_argb_8.Red, Green=split_argb_8.Green, Blue=split_argb_8.Blue)
data_dam_16 = DataDam(DataDataA=conmesh_13, BufferDelay=10000000, BufferMode=0)  # disabled
colour_rgb_f_12 = ColourRGBF(Alpha=1, Red=split_argb_7.Red, Green=split_argb_7.Green, Blue=split_argb_7.Blue)
data_dam_17 = DataDam(DataDataA=conmesh_13, BufferDelay=10000000, BufferMode=0)  # disabled
colour_rgb_f_13 = ColourRGBF(Alpha=ghpython_script_16.a, Red=split_argb_6.Red, Green=split_argb_6.Green, Blue=split_argb_6.Blue)
colour_rgb_f_14 = ColourRGBF(Alpha=number_slider_18, Red=split_argb_9.Red, Green=split_argb_9.Green, Blue=split_argb_9.Blue)
colour_rgb_f_15 = ColourRGBF(Alpha=number_slider_17, Red=split_argb_9.Red, Green=split_argb_9.Green, Blue=split_argb_9.Blue)
colour_rgb_f_16 = ColourRGBF(Alpha=number_slider_17, Red=split_argb_10.Red, Green=split_argb_10.Green, Blue=split_argb_10.Blue)
colour_rgb_f_17 = ColourRGBF(Alpha=number_slider_18, Red=split_argb_10.Red, Green=split_argb_10.Green, Blue=split_argb_10.Blue)
mesh_29 = Mesh(data_dam_12)  # disabled
mesh_30 = Mesh(data_dam_14)  # disabled
mesh_31 = Mesh(data_dam_13)  # disabled
mesh_32 = Mesh(data_dam_15)  # disabled
conmesh_15 = ConstructMesh(Vertices=demesh_19.Vertices, Faces=demesh_19.Faces, Colours=colour_rgb_f_8)  # disabled
cluster = Cluster(colour=colour_rgb_f_9)
cluster_2 = Cluster(colour=colour_rgb_f_10)
list_item_17 = ListItem(List=colour_rgb_f_8, Index=0, Wrap=True)  # -> Item, Item1, Item2; disabled
move_6 = Move(Geometry=conmesh_11, Motion=unit_x_3)  # -> Geometry, Transform
cluster_3 = Cluster(colour=colour_rgb_f_11)
cluster_4 = Cluster(colour=colour_rgb_f_13)
mesh_33 = Mesh(data_dam_16)  # disabled
mesh_34 = Mesh(data_dam_17)  # disabled
addition_3 = Addition(A=list_item_17.Item, B=list_item_17.Item1, C=list_item_17.Item2)  # disabled
conmesh_16 = ConstructMesh(Vertices=demesh_20.Vertices, Faces=demesh_20.Faces, Colours=cluster)
conmesh_17 = ConstructMesh(Vertices=demesh_20.Vertices, Faces=demesh_20.Faces, Colours=cluster_3)
conmesh_18 = ConstructMesh(Vertices=demesh_20.Vertices, Faces=demesh_20.Faces, Colours=cluster_2)
conmesh_19 = ConstructMesh(Vertices=demesh_20.Vertices, Faces=demesh_20.Faces, Colours=colour_rgb_f_16)
conmesh_20 = ConstructMesh(Vertices=demesh_20.Vertices, Faces=demesh_20.Faces, Colours=colour_rgb_f_15)
conmesh_21 = ConstructMesh(Vertices=demesh_20.Vertices, Faces=demesh_20.Faces, Colours=cluster_4)
list_item_18 = ListItem(List=merge_3, Index=0, Wrap=True)  # -> Item, Item1, Item2
brep = Brep(<brep referenced from the Rhino model>)
mesh_35 = MeshBrep(
    Brep=brep,
    Settings={GridMaxCount=0, GridMinCount=16, JaggedSeams=False, MaxEdgeLength=0, MinEdgeLength=0.0001, MinTolerance=0, Refine=True, RefineAngle=0, RelativeTolerance=0.65, SimplePlanes=True, Tolerance=0})
mesh_36 = Mesh(<mesh referenced from the Rhino model>)
qrmesh = QuadRemesh(Mesh=mesh_36, Settings={aqc=True, as=50, dhe=True, gci=0, null=False, pme=0, sa=0, tqc=2000})
mesh_37 = Mesh(<mesh referenced from the Rhino model>)  # disabled
mesh_triangulate = MeshTriangulate(Mesh=mesh_37, ShortDiagonal=True)  # disabled
panel_46 = Panel("50")  # disabled
mesh_38 = Mesh(qrmesh)
weld = WeldMesh(Mesh=flatten(mesh_38), Angle=3.141592654)
deconstruct_mesh_2 = DeconstructMesh(Mesh=mesh_triangulate)  # -> Vertices, Faces, Colours, Normals; disabled
face_normals = FaceNormals(Mesh=mesh_triangulate)  # -> Centers, Normals; disabled
amplitude_3 = Amplitude(Vector=face_normals.Normals, Amplitude=panel_46)  # disabled
mjoin = MeshJoin(Meshes=mesh_38)
number_slider_19 = Slider(1.03, range=0..10)
deconstruct_face = DeconstructFace(Face=deconstruct_mesh_2.Faces)  # -> CornerA, CornerB, CornerC, CornerD; disabled
ghpython_script_20 = GhPythonScript(x=amplitude_3)  # -> out, a; inputs x: list; disabled
# ---------- ghpython_script_20: Python ----------
a=[]
for i in range(len(x)):
    if i%2==0:
        a.append(1)
    else:
        a.append(-1)
# ---------- end ghpython_script_20 ----------
panel_47 = Panel(ghpython_script_20.a)  # disabled
multiplication_15 = Multiplication(A=amplitude_3, B=ghpython_script_20.a)  # disabled
move_7 = Move(Geometry=face_normals.Centers, Motion=multiplication_15)  # -> Geometry, Transform; disabled
list_item_19 = ListItem(List=deconstruct_mesh_2.Vertices, Index=deconstruct_face.CornerA, Wrap=True)  # disabled
list_item_20 = ListItem(List=deconstruct_mesh_2.Vertices, Index=deconstruct_face.CornerC, Wrap=True)  # disabled
list_item_21 = ListItem(List=deconstruct_mesh_2.Vertices, Index=deconstruct_face.CornerB, Wrap=True)  # disabled
wbcatmullclark = WeaverbirdsCatmullClarkSubdivision(MeshCurves=mjoin, Level=Slider(2.66, range=0..3), SmoothNakedEdges=0)
mesh_39 = Mesh(wbcatmullclark)
merge_4 = Merge(Data1=graft(list_item_19), Data2=graft(list_item_21), Data3=graft(move_7.Geometry))  # -> simplify(Result); disabled
merge_5 = Merge(Data1=graft(list_item_21), Data2=graft(list_item_20), Data3=graft(move_7.Geometry))  # -> simplify(Result); disabled
merge_6 = Merge(Data1=graft(list_item_20), Data2=graft(list_item_19), Data3=graft(move_7.Geometry))  # -> simplify(Result); disabled
panel_48 = Panel(wbcatmullclark)
mesh_triangulate_2 = MeshTriangulate(Mesh=mesh_39, ShortDiagonal=True)
mesh_edges_2 = MeshEdges(Mesh=mesh_triangulate_2)  # -> NakedEdges, InteriorEdges, NonManifoldEdges
entwine = Entwine(Branch0X=merge_4, Branch1X=merge_5, Branch2X=merge_6, FlattenInputs=False)  # disabled
ghpython_script_21 = GhPythonScript(x=entwine)  # -> out, a; inputs x: tree; disabled
# ---------- ghpython_script_21: Python ----------
__author__ = "Ke Dao"
__version__ = "2024.08.28"

import rhinoscriptsyntax as rs
import Grasshopper.DataTree as dt
import Grasshopper.Kernel.Data.GH_Path as ph
a=dt[object]()
k=-1
for i in x.Branches:
    k+=1
    a.AddRange(i,ph(k))
# ---------- end ghpython_script_21 ----------
panel_49 = Panel(ghpython_script_21.a)  # disabled
construct_mesh = ConstructMesh(Vertices=ghpython_script_21.a, Faces={A=0, B=1, C=2, D=2})  # -> flatten(Mesh); disabled
mesh_join = MeshJoin(Meshes=construct_mesh)  # disabled

# ----
# Load Slicer
panel_50 = Panel("curved_slicer_saddle")
button_15 = Button()
csfindfilenames_10 = CsFindFilenames(recompute=button_15, starts_with="curved_slicer", ends_with=".json", path=py, folder_name=data_2)  # -> out, filenames, n; inputs recompute: Boolean; same code as csfindfilenames

list_item_22 = ListItem(List=csfindfilenames_10.filenames, Index=0, Wrap=True)

csloadslicer_2 = CsLoadSlicer(recompute=button_15, json_name=list_item_22, path=py, folder_name=data_2)  # -> out, mesh, paths, are_closed, all_points, gras, pts; inputs recompute: Boolean; same code as csloadslicer

curve_9 = Curve(csloadslicer_2.paths)
panel_51 = Panel(curve_9)
explode_tree_11 = ExplodeTree(Data=curve_9)  # -> Branch0, Branch1, Branch2, Branch3, Branch4, Branch5, Branch6, Branch7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
curve_10 = Curve(explode_tree_11.Branch7)
panel_52 = Panel(curve_10)
list_item_23 = ListItem(List=curve_10, Index="1", Wrap=True)

# ----
# Load BaseBoundaries
panel_53 = Panel("boundaries.json")

csloadjsonboundary = CsLoadJsonBoundary(recompute=Button(), json_name=panel_53, path=py, folder_name=data_2)  # -> out, points, vectors, n; inputs recompute: Boolean
# ---------- csloadjsonboundary: Python ----------
"""
Loads a json file that stores a dictionary of BaseBoundary classes in the format:
data['0']=base_boundary_1.to_data(), ..., data['N']=base_boundary_N.to_data()


"""

import compas_slicer_ghpython.visualization as gh_compas_slicer
gh_compas_slicer = reload(gh_compas_slicer)

if json_name and path and folder_name:
    points, vectors, n = gh_compas_slicer.load_base_boundaries(path, folder_name, json_name)
else:
    gh_compas_slicer.missing_input()
# ---------- end csloadjsonboundary ----------

no_of_boundaries = Panel(csloadjsonboundary.n)
vdis_3 = VectorDisplay(Anchor=csloadjsonboundary.points, Vector=expr("x*3", csloadjsonboundary.vectors))

# ----
# Load Polylines
button_16 = Button()

csloadjsonpolylines = CsLoadJsonPolylines(recompute=button_16, json_name="point_clusters_polylines_0.json", path=py, folder_name=data_2)  # -> out, polylines, points; inputs recompute: Boolean
# ---------- csloadjsonpolylines: Python ----------
"""
Loads a json file that stores a dictionary of N polylines in the format:
data['0']=points_dict_0, ..., data['N'] = points_dict_N, where points_dict is in the format:
points_dict['0']=[x0,y0,z0], ...,  points_dict['N']=[xN,yN,zN]


"""

import compas_slicer_ghpython.visualization as gh_compas_slicer
gh_compas_slicer = reload(gh_compas_slicer)

if json_name and path and folder_name:
    polylines, points = gh_compas_slicer.load_json_polylines(path, folder_name, json_name)
else:
    gh_compas_slicer.missing_input()
# ---------- end csloadjsonpolylines ----------

crv_11 = Curve(csloadjsonpolylines.polylines)

# ----
# Load Data
# Load vertex indices
panel_54 = Panel("saddles_high.json")
demesh_21 = DeconstructMesh(Mesh=mesh_5)  # -> Vertices, Faces, Colours, Normals
number_slider_20 = Slider(20, range=0..20)
merge_7 = Merge(Data1=panel_54, Data2="height_saddles.json", Data3="saddles.json")
item_10 = ListItem(List=demesh_21.Vertices, Index="4522", Wrap=True)
cloud_5 = CloudDisplay(Points=item_10, Colours=ColourSwatch(SwatchColor=RGB(107, 235, 52)), Size=number_slider_20, SpriteType=1)

list_length_7 = ListLength(List=demesh_21.Vertices)
list_item_24 = ListItem(List=demesh_21.Vertices, Index="2250", Wrap=True)
list_item_25 = ListItem(List=demesh_21.Vertices, Index="2251", Wrap=True)
list_item_26 = ListItem(List=demesh_21.Vertices, Index="6036", Wrap=True)
list_item_27 = ListItem(List=demesh_21.Vertices, Index=[13729, 8039, 8041, 8047, 1936], Wrap=True)
data_dam_18 = DataDam(DataDataA=demesh_21.Vertices, BufferDelay=10000000, BufferMode=0)
data_dam_19 = DataDam(DataDataA=demesh_21.Vertices, BufferDelay=10000000, BufferMode=0)
closest_points = ClosestPoints(Point=point_3, Cloud=demesh_21.Vertices, Count="1")  # -> ClosestPoint, CPIndex, Distance
csloadjsondata_3 = CsLoadJsonData(recompute=Button(), json_name=merge_7, path=py, folder_name=data_2)  # -> out, simplify(data); inputs recompute: Boolean; same code as csloadjsondata
move_8 = Move(Geometry=list_item_24, Motion=multiplication_11)  # -> Geometry, Transform

branch_4 = TreeBranch(Tree=csloadjsondata_3.data, Path="2", MaintainPaths=True)
branch_5 = TreeBranch(Tree=csloadjsondata_3.data, Path="1", MaintainPaths=True)
branch_6 = TreeBranch(Tree=csloadjsondata_3.data, Path="0", MaintainPaths=True)
item_11 = ListItem(List=demesh_21.Vertices, Index=branch_4, Wrap=True)
item_12 = ListItem(List=demesh_21.Vertices, Index=branch_5, Wrap=True)
cloud_6 = CloudDisplay(Points=item_12, Colours=ColourSwatch(SwatchColor=RGB(52, 52, 235)), Size=number_slider_20, SpriteType=1)
cloud_7 = CloudDisplay(Points=item_11, Colours=ColourSwatch(SwatchColor=RGB(255, 0, 0)), Size=number_slider_20, SpriteType=1)

merge_8 = Merge(Data1=flatten(item_11), Data2=flatten(curve_middle_3), Data3=flatten(curve_middle_4))  # disabled
list_length_8 = ListLength(List=merge_8)  # disabled
list_item_28 = ListItem(List=demesh_21.Vertices, Index=csinterpolation_3.a, Wrap=True)
list_item_29 = ListItem(List=demesh_21.Vertices, Index=csinterpolation_3.b, Wrap=True)
line_2 = Line(StartPoint=list_item_25, EndPoint=list_item_26)
line_3 = Line(StartPoint=list_item_24, EndPoint=move_8.Geometry)
line_4 = Line(StartPoint=list_item_29, EndPoint=list_item_28)
series_2 = Series(Start=0, Step=1, Count=list_length_8)  # disabled
point_list = PointList(Points=item_12, Size="20")
curve_curve = CurveCurve(CurveA=line_3, CurveB=line_2)  # -> Points, ParamsA, ParamsB
list_item_30 = ListItem(List=series_2, Index=0, Wrap=True)  # -> Item1, Item; disabled
point_list_2 = PointList(Points=item_12, Size="10")
point_list_3 = PointList(Points=merge_8, Size=number_slider_12)  # disabled
panel_55 = Panel(series_2)  # disabled
list_item_31 = ListItem(List=merge_8, Index=csinterpolation_16.influences, Wrap=True)  # disabled
transform_9 = Transform(Geometry=item_11, Transform=list_item_12.Item)
panel_56 = Panel(item_12)
gradient_27 = Gradient(
    LowerLimit=list_item_30.Item,
    UpperLimit=list_length_8,
    Parameter=series_2,
    stops=[0: RGB(255, 0, 0), 0.0472: RGB(255, 0, 0), 0.198: RGB(0, 0, 255), 0.303: RGB(0, 255, 0), 0.407: RGB(0, 255, 0), 0.504: RGB(0, 255, 0), 0.604: RGB(0, 255, 0), 0.704: RGB(0, 255, 0), 0.803: RGB(0, 255, 0), 0.901: RGB(0, 255, 0)])  # disabled
gradient_28 = Gradient(
    LowerLimit=list_item_30.Item,
    UpperLimit=list_length_8,
    Parameter=series_2,
    stops=[0: RGB(255, 0, 0), 0.103: RGB(255, 0, 0), 0.198: RGB(0, 0, 255), 0.303: RGB(0, 0, 255), 0.407: RGB(255, 0, 0), 0.504: RGB(255, 0, 0), 0.604: RGB(0, 255, 0), 0.704: RGB(0, 0, 255), 0.803: RGB(0, 0, 255), 0.901: RGB(0, 255, 0)])  # disabled
gradient_29 = Gradient(
    LowerLimit=list_item_30.Item,
    UpperLimit=list_length_8,
    Parameter=series_2,
    stops=[0: RGB(236, 224, 39), 0: RGB(128, 0, 0), 0.145: RGB(188, 143, 143), 0.276: RGB(255, 99, 71), 0.413: RGB(255, 228, 181), 0.532: RGB(143, 188, 139), 0.656: RGB(152, 251, 152), 0.77: RGB(135, 206, 235), 0.887: RGB(176, 196, 222), 1: RGB(70, 130, 180)])  # disabled
list_item_32 = ListItem(List=list_item_31, Index=0, Wrap=True)  # -> Item, Item1; disabled
split_argb_11 = SplitARGB(Colour=gradient_29)  # -> Alpha, Red, Green, Blue; disabled
transform_10 = Transform(Geometry=transform_9, Transform=list_item_12.Item1)
line_5 = Line(StartPoint=list_item_32.Item, EndPoint=list_item_32.Item1)  # disabled
panel_57 = Panel(list_item_31)  # disabled
ghpython_script_22 = GhPythonScript(x=split_argb_11.Red, y=split_argb_11.Green, z=split_argb_11.Blue)  # -> out, a, b, c; disabled
# ---------- ghpython_script_22: Python ----------
__author__ = "Ke Dao"
__version__ = "2024.10.06"

import rhinoscriptsyntax as rs
max_itm=max([x,y,z])
scale=1/max_itm
a=x*scale
b=y*scale
c=z*scale
# ---------- end ghpython_script_22 ----------
colour_rgb_f_18 = ColourRGBF(Alpha=1, Red=ghpython_script_22.a, Green=ghpython_script_22.b, Blue=ghpython_script_22.c)  # disabled
cloud_8 = CloudDisplay(Points=merge_8, Colours=colour_rgb_f_18, Size=number_slider_11, SpriteType=1)  # disabled
list_item_33 = ListItem(List=colour_rgb_f_18, Index=panel_42, Wrap=True)  # disabled
item_13 = ListItem(List=subtraction_7, Index=branch_4, Wrap=True)
item_14 = ListItem(List=subtraction_6, Index=branch_4, Wrap=True)
addition_4 = Addition(A=item_13, B="84.4")
data_dam_20 = DataDam(DataDataA=item_13, BufferDelay=10000000, BufferMode=0)
data_dam_21 = DataDam(DataDataA=item_14, BufferDelay=10000000, BufferMode=0)
item_15 = ListItem(List=flatten_tree_4, Index=branch_4, Wrap=True)
panel_58 = Panel(colour_rgb_f_18)  # disabled
integer_3 = Integer(data_dam_20)
closest_point = ClosestPoint(Point=point_5, Cloud=demesh_21.Vertices)  # -> ClosestPoint, CPIndex, Distance

list_length_9 = ListLength(List=flatten_tree_3)
subtraction_8 = Subtraction(A="15", B="1")
division_6 = Division(A=list_length_9, B=subtraction_8)
series_3 = Series(Start=0, Step=division_6, Count="15")
integer_4 = Integer(closest_point.CPIndex)
list_item_34 = ListItem(List=demesh_21.Vertices, Index=integer_4, Wrap=True)

integer_5 = Integer(data_dam_21)
integer_6 = Integer(item_15)
gradient_30 = Gradient(
    LowerLimit=dedomain_16.Start,
    UpperLimit=dedomain_16.End,
    Parameter=integer_3,
    stops=[0: RGB(224, 224, 224), 1: RGB(64, 64, 64)])
gradient_31 = Gradient(
    LowerLimit=dedomain_16.Start,
    UpperLimit=dedomain_16.End,
    Parameter=integer_5,
    stops=[0: RGB(224, 224, 224), 1: RGB(64, 64, 64)])
integer_7 = Integer(integer_6)
split_argb_12 = SplitARGB(Colour=gradient_31)  # -> Alpha, Red, Green, Blue
split_argb_13 = SplitARGB(Colour=gradient_30)  # -> Alpha, Red, Green, Blue
list_item_35 = ListItem(List=flatten_tree_3, Index=integer_4, Wrap=True)
gradient_32 = Gradient(
    LowerLimit=dedomain_6.Start,
    UpperLimit=dedomain_6.End,
    Parameter=list_item_35,
    stops=[0: RGB(245, 245, 245), 1: RGB(255, 0, 0)])
split_argb_14 = SplitARGB(Colour=gradient_32)  # -> Alpha, Red, Green, Blue
list_item_36 = ListItem(List=flatten_tree_4, Index=integer_4, Wrap=True)
gradient_33 = Gradient(
    LowerLimit=dedomain_6.Start,
    UpperLimit=dedomain_6.End,
    Parameter=list_item_36,
    stops=[0: RGB(245, 245, 245), 0.991: RGB(0, 0, 255)])
split_argb_15 = SplitARGB(Colour=gradient_33)  # -> Alpha, Red, Green, Blue
list_item_37 = ListItem(List=integer_2, Index=integer_4, Wrap=True)
list_item_38 = ListItem(List=integer, Index=integer_4, Wrap=True)
colour_rgb_f_19 = ColourRGBF(Alpha=1, Red=split_argb_14.Red, Green=split_argb_14.Green, Blue=split_argb_14.Blue)
colour_rgb_f_20 = ColourRGBF(Alpha=1, Red=split_argb_15.Red, Green=split_argb_15.Green, Blue=split_argb_15.Blue)
colour_rgb_f_21 = ColourRGBF(Alpha=number_slider_17, Red=split_argb_12.Red, Green=split_argb_12.Green, Blue=split_argb_12.Blue)
colour_rgb_f_22 = ColourRGBF(Alpha=number_slider_17, Red=split_argb_13.Red, Green=split_argb_13.Green, Blue=split_argb_13.Blue)
panel_59 = Panel(list_item_34)
item_16 = ListItem(List=colour_rgb_f_17, Index=branch_4, Wrap=True)
item_17 = ListItem(List=demesh_21.Vertices, Index=branch_4, Wrap=True)
item_18 = ListItem(List=colour_rgb_f_14, Index=branch_4, Wrap=True)

# ----
# Load Data
# Gradient angle
panel_60 = Panel("gradient.json")
number_slider_21 = Slider(0.1, range=0..0.1)
number_slider_22 = Slider(1, range=0..1)
mesh_40 = Mesh(mesh_5)
demesh_22 = DeconstructMesh(Mesh=mesh_40)  # -> Vertices, Faces, Colours, Normals

csloadjsondata_4 = CsLoadJsonData(recompute=Button(), json_name=panel_60, path=py, folder_name=data_2)  # -> out, data; inputs recompute: Boolean
# ---------- csloadjsondata_4: Python ----------
"""Loads a json file from the output folder. """

import compas_slicer_ghpython.visualization as gh_compas_slicer
gh_compas_slicer = reload(gh_compas_slicer)
import visualization as vis
import math
vis=reload(vis)

if json_name and path and folder_name:
    data = vis.load_gradient_tangent(path, folder_name, json_name)
    if sum(data)<0:
        data=[-x for x in data]
else:
    gh_compas_slicer.missing_input()
# ---------- end csloadjsondata_4 ----------

data_3 = Data(csloadjsondata_4.data)
bnd_18 = Bounds(Numbers=data_3)
dedomain_17 = DeconstructDomain(Domain=bnd_18)  # -> Start, End
avr_2 = Average(Input=data_3)
gradient_34 = Gradient(
    LowerLimit="0",
    UpperLimit="1.57",
    Parameter=data_3,
    stops=[0: RGB(234, 38, 0), 0.25: RGB(234, 126, 0), 0.5: RGB(254, 244, 84), 0.75: RGB(173, 203, 249), 1: RGB(75, 107, 169)])
max_2 = Panel(dedomain_17.End)
average_2 = Panel(avr_2)
min_2 = Panel(dedomain_17.Start)
conmesh_22 = ConstructMesh(Vertices=demesh_22.Vertices, Faces=demesh_22.Faces, Colours=gradient_34)

panel_61 = Panel(data_3)

# ----
# Load Data
# Gradient norm
panel_62 = Panel("gradient_norm.json")
number_slider_23 = Slider(0, range=0..0.1)
number_slider_24 = Slider(0, range=0..1)
mesh_41 = Mesh(mesh_5)
demesh_23 = DeconstructMesh(Mesh=mesh_41)  # -> Vertices, Faces, Colours, Normals

csloadjsondata_5 = CsLoadJsonData(recompute=Button(), json_name=panel_62, path=py, folder_name=data_2)  # -> out, data; inputs recompute: Boolean; same code as csloadjsondata
average_3 = Average(Input=csloadjsondata_5.data)
data_dam_22 = DataDam(DataDataA=csloadjsondata_5.data, BufferDelay=10000000, BufferMode=0)
division_7 = Division(A="1", B=csloadjsondata_5.data)
panel_63 = Panel(division_7)
ghpython_script_23 = GhPythonScript(x=csloadjsondata_5.data)  # -> out, a; inputs x: list
# ---------- ghpython_script_23: Python ----------
import statistics

a_=[]
for i in x:
    if i!=0:
        a_.append(1/i)
    else:
        print(i,'bug')
        a_.append(0)
mean=statistics.mean(a_)
print(mean)
a=[(i-mean)/mean for i in a_]
# ---------- end ghpython_script_23 ----------
panel_64 = Panel(ghpython_script_23.a)
gradient_35 = Gradient(
    LowerLimit="-0.3",
    UpperLimit="0.3",
    Parameter=ghpython_script_23.a,
    stops=[0: RGB(128, 0, 0), 0.102: RGB(255, 128, 0), 0.202: RGB(255, 192, 128), 0.303: RGB(255, 255, 0), 0.4: RGB(255, 255, 128), 0.498: RGB(0, 255, 0), 0.604: RGB(128, 255, 255), 0.7: RGB(0, 255, 255), 0.8: RGB(128, 192, 255), 0.901: RGB(0, 128, 255), 1: RGB(0, 0, 255)])
split_argb_16 = SplitARGB(Colour=gradient_35)  # -> Alpha, Red, Green, Blue
colour_rgb_f_23 = ColourRGBF(Alpha=Slider(0.5, range=0..1), Red=split_argb_16.Red, Green=split_argb_16.Green, Blue=split_argb_16.Blue)

csinterpolation_24 = CsInterpolation(recompute=Button(), json_name="influences.json", path=py, folder_name=data_2)  # -> out, influences; inputs recompute: Boolean
# ---------- csinterpolation_24: Python ----------
"""
Interpolation of the two distance fields that are loaded from the 'output' folder. 

"""
#asdf
import compas_slicer_ghpython.visualization as gh_compas_slicer
import Grasshopper.DataTree as dt
import Grasshopper.Kernel.Data.GH_Path as ph
from visualization import load_influence 
import time
#gh_compas_slicer = reload(gh_compas_slicer)
start_time=time.time()
influences=load_influence(path,folder_name,json_name)
print time.time()-start_time
#def veky_influence(veky,influences_list):
#    influence_list = influences_list[veky]
#    return influence_list
#
#influences_list = gh_compas_slicer.influence_fields(path, folder_name, json_name)
#VN=len(influences_list)
##print(influences_list)
#for veky in range(VN):
#    tree_path=ph(veky)
#    influence=veky_influence(veky,influences_list)
#    print(influence)
#    influences.AddRange(influence,tree_path)
# ---------- end csinterpolation_24 ----------
explode_tree_12 = ExplodeTree(Data=csinterpolation_24.influences)
list_length_10 = ListLength(List=explode_tree_12)
list_length_11 = ListLength(List=explode_tree_12)
number_slider_25 = Slider(0.7, range=0..1)
mesh_42 = Mesh(mesh_5)
demesh_24 = DeconstructMesh(Mesh=mesh_42)  # -> Vertices, Faces, Colours, Normals

csinterpolation_25 = CsInterpolation(recompute=button_7, compute=boolean_toggle, json_name="influences.json", path=py, folder_name=data_2, frame_number="101")  # -> out, influences_list, simplify(nested_influences); inputs recompute: Boolean, frame_number: Int32; disabled; same code as csinterpolation_2
data_dam_23 = DataDam(DataDataA=csinterpolation_25.nested_influences, BufferDelay=10000000, BufferMode=0)  # disabled
ghpython_script_24 = GhPythonScript(nested_weights=data_dam_23, frame=number_slider)  # -> out, influences; inputs nested_weights: tree; disabled; same code as ghpython_script_6
flip_matrix_2 = FlipMatrix(Data=ghpython_script_24.influences)  # -> simplify(Data); disabled
subtraction_9 = Subtraction(A=list_length_10, B="4")

data_4 = Data(division_7)
bnd_19 = Bounds(Numbers=data_4)
dedomain_18 = DeconstructDomain(Domain=bnd_19)  # -> Start, End
avr_3 = Average(Input=data_4)
max_3 = Panel(dedomain_18.End)
average_4 = Panel(avr_3)
min_3 = Panel(dedomain_18.Start)
conmesh_23 = ConstructMesh(Vertices=demesh_23.Vertices, Faces=demesh_23.Faces, Colours=colour_rgb_f_23)

average_5 = Average(Input=data_4)
multiplication_16 = Multiplication(A=average_5, B="0")
multiplication_17 = Multiplication(A=average_5, B="2")
panel_66 = Panel(average_5)

gradient_36 = Gradient(
    LowerLimit=multiplication_17,
    UpperLimit=multiplication_16,
    Parameter=data_4,
    stops=[0: RGB(255, 128, 0), 0.301: RGB(255, 255, 0), 0.401: RGB(192, 255, 0), 0.45: RGB(90, 255, 0), 0.472: RGB(40, 230, 0), 0.489: RGB(30, 210, 0), 0.502: RGB(0, 192, 0), 0.513: RGB(0, 210, 30), 0.525: RGB(0, 230, 40), 0.545: RGB(0, 255, 90)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])

division_8 = Division(A="1", B=subtraction_9)
series_4 = Series(Start=0, Step=division_8, Count=list_length_10)

ghpython_script_25 = GhPythonScript(x=series_4)  # -> out, a
# ---------- ghpython_script_25: Python ----------
if x >=0.99:
    a=0
else:
    a=1
# ---------- end ghpython_script_25 ----------
ghpython_script_26 = GhPythonScript(x=series_4)  # -> out, a
# ---------- ghpython_script_26: Python ----------
if x >=1:
    a=1
else:
    a=x
# ---------- end ghpython_script_26 ----------
division_9 = Division(A=ghpython_script_25.a, B="2")
multiplication_18 = Multiplication(A=ghpython_script_25.a, B=csinterpolation_24.influences)
ghpython_script_27 = GhPythonScript(x=multiplication_18)  # -> out, a; inputs x: list
# ---------- ghpython_script_27: Python ----------
a=sum(x)
# ---------- end ghpython_script_27 ----------

colour_hsl_3 = ColourHSL(Alpha=ghpython_script_25.a, Hue=ghpython_script_26.a, Saturation=1, Luminance=division_9)  # -> simplify(Colour)
multiplication_19 = Multiplication(A=colour_hsl_3, B=csinterpolation_24.influences)
split_argb_17 = SplitARGB(Colour=multiplication_19)  # -> Alpha, Red, Green, Blue
ghpython_script_28 = GhPythonScript(x=split_argb_17.Blue)  # -> out, a; inputs x: list; same code as ghpython_script_27
ghpython_script_29 = GhPythonScript(x=split_argb_17.Green)  # -> out, a; inputs x: list; same code as ghpython_script_27
ghpython_script_30 = GhPythonScript(x=split_argb_17.Red)  # -> out, a; inputs x: list; same code as ghpython_script_27
colour_rgb_f_24 = ColourRGBF(Alpha=ghpython_script_27.a, Red=ghpython_script_30.a, Green=ghpython_script_29.a, Blue=ghpython_script_28.a)  # -> flatten(Colour)
conmesh_24 = ConstructMesh(Vertices=demesh_24.Vertices, Faces=demesh_24.Faces, Colours=colour_rgb_f_24)

panel_67 = Panel(split_argb_17.Red)

# ----
# Load multiple meshes by name
button_17 = Button()

csloadmeshesbyname = CsLoadMeshesByName(recompute=button_17, starts_with="split_mesh_", ends_with=".obj", path=py, folder_name=data_2)  # -> out, loaded_meshes, number_of_meshes; inputs recompute: Boolean
# ---------- csloadmeshesbyname: Python ----------
"""
Loads all the meshes from the output directory that have the specified filename, and displays them with color.

"""

import compas_slicer_ghpython.visualization as gh_compas_slicer
gh_compas_slicer = reload(gh_compas_slicer)

if starts_with and ends_with and path and folder_name:
    loaded_meshes = gh_compas_slicer.load_multiple_meshes(starts_with, ends_with, path, folder_name)
    number_of_meshes = len(loaded_meshes)
else:
    gh_compas_slicer.missing_input()
# ---------- end csloadmeshesbyname ----------
mesh_43 = Mesh(csloadmeshesbyname.loaded_meshes)

medges_2 = MeshEdges(Mesh=csloadmeshesbyname.loaded_meshes)  # -> NakedEdges, InteriorEdges, NonManifoldEdges
number_of_meshes = Panel(csloadmeshesbyname.number_of_meshes)
crv_12 = Curve(medges_2.NakedEdges)

# ==== cluster Cluster
colour = ClusterInput()
split_ahsl = SplitAHSL(Colour=colour)  # -> Alpha, Hue, Saturation, Luminance
panel = Panel("1")
ghpython_script = GhPythonScript(x=split_ahsl.Saturation)  # -> out, a
# ---------- ghpython_script: Python ----------
if x==0:
    a=0
else:
    a=1
# ---------- end ghpython_script ----------
panel_2 = Panel(ghpython_script.a)
colour_hsl = ColourHSL(Alpha=split_ahsl.Alpha, Hue=split_ahsl.Hue, Saturation=ghpython_script.a, Luminance=split_ahsl.Luminance)
colour_2 = ClusterOutput(colour_hsl)
